# Dynamo graph RebarCircularColumns.dyn (Dynamo 2.10.1.3976)

# group: Cicular reinforced concrete columns - longitudinal and transversal reinforcement
geometry_of_each_circular_column = Filename("..\..\..\..\..\..\..\DynamoRevit\Dynamo_visualization\dim_cols_circ_collection.csv")  # graph input
importCSV = Data.ImportCSV(filePath=geometry_of_each_circular_column)
column_dimensions = List.Transpose(lists=importCSV)
location_of_circular_columns = Filename("..\..\..\..\..\..\..\DynamoRevit\Dynamo_visualization\coord_base_columns_circ.csv")
importCSV_2 = Data.ImportCSV(filePath=location_of_circular_columns)
column_location = List.Transpose(lists=importCSV_2)
number_of_rebars_of_each_column = Filename("..\..\..\..\..\..\..\DynamoRevit\Dynamo_visualization\nrebar_cols_circ_collection.csv")  # graph input
importCSV_3 = Data.ImportCSV(filePath=number_of_rebars_of_each_column)
number_of_rebars_of_each_column_2 = List.Transpose(lists=importCSV_3)
distribution_of_rebars_in_each = Filename("..\..\..\..\..\..\..\DynamoRevit\Dynamo_visualization\collection_disposition_rebar_cols_circ.csv")  # "Distribution of rebars in each column"; graph input
importCSV_4 = Data.ImportCSV(filePath=distribution_of_rebars_in_each)
transpose = List.Transpose(lists=importCSV_4)
rebar_diameter_s_index = Filename("..\..\..\..\..\..\..\DynamoRevit\Dynamo_visualization\collection_type_bar_cols_circ.csv")  # graph input
importCSV_5 = Data.ImportCSV(filePath=rebar_diameter_s_index)
transpose_2 = List.Transpose(lists=importCSV_5)
longitudinal_rebar_columns = Python(IN[0]=column_dimensions, IN[1]=column_location, IN[2]=number_of_rebars_of_each_column_2, IN[3]=transpose, IN[4]=transpose_2)  # IronPython2
# ---------- longitudinal_rebar_columns.python (43 lines) ----------
import clr
clr.AddReference('ProtoGeometry')
from Autodesk.DesignScript.Geometry import *
dataEnteringNode = IN

# INPUT
basic=IN[0]
coord_col=IN[1]
nbars_col=IN[2]
coordbars=IN[3]
tipovar=IN[4]

availableRebar=[[4,1.27,1.266768698],
				[5,1.5875,1.97932609],
				[6,1.905,2.85022957],
				[8,2.54,5.067074791],
				[9,2.8575,6.413016532],
				[10,3.175,7.917304361],
				[12,3.81,11.40091828]]
# MAIN LOOP
list_bars=[]
ncols=len(coord_col)
sumanv_col=0
nvar=0
for i in range(0,ncols):
	nvar=nvar+nbars_col[i][0]
	hc=float(basic[i][1])*0.01
	for b in range(0+int(sumanv_col),int(nvar)):
		xvar=coordbars[b][0]*0.01+float(coord_col[i][0])*0.01
		yvar=coordbars[b][1]*0.01+float(coord_col[i][1])*0.01
		
		rvar=availableRebar[int(tipovar[b][0])-1][0]/8*2.54*0.01*0.5
		
		center_point=Point.ByCoordinates(xvar,yvar,float(coord_col[i][2])*0.01+0.5*hc)
		myColCirc=Circle.ByCenterPointRadius(center_point,rvar)
		psur=Surface.ByPatch(myColCirc)
		ptorre=Surface.Thicken(psur,hc)
		list_bars.append(ptorre)
		
	sumanv_col=sumanv_col+nbars_col[i][0]
		
	
OUT=list_bars
# ----------------------------------------
color_palette = ColorPalette({R: 34, G: 139, B: 34, A: 255})
byGeometryColor = Modifiers.GeometryColor.ByGeometryColor(geometry=longitudinal_rebar_columns, color=color_palette)
column_volume = Python(IN[0]=column_dimensions, IN[1]=column_location)  # IronPython2
# ---------- column_volume.python (24 lines) ----------
import clr
clr.AddReference('ProtoGeometry')
from Autodesk.DesignScript.Geometry import *
dataEnteringNode = IN

# INPUT
basic=IN[0]
coord_col=IN[1]

# MAIN LOOP
list_cols=[]
ncols=len(coord_col)
for i in range(0,ncols):
	hc=float(basic[i][1])*0.01
	diam=basic[i][0]*0.01
	
	center_point=Point.ByCoordinates(coord_col[i][0]*0.01,coord_col[i][1]*0.01,coord_col[i][2]*0.001+0.5*hc)
	myColCirc=Circle.ByCenterPointRadius(center_point,diam*0.5)
	psur=Surface.ByPatch(myColCirc)
	ptorre=Surface.Thicken(psur,hc)
	list_cols.append(ptorre)
		
	
OUT=list_cols
# ----------------------------------------
color_palette_2 = ColorPalette({R: 255, G: 182, B: 193, A: 255})
transparency_of_columns_solids = DoubleSlider(2.8, range=1..10 step 0.1)
divide = Color.Divide(c1=color_palette_2, div=transparency_of_columns_solids)
byGeometryColor_2 = Modifiers.GeometryColor.ByGeometryColor(geometry=column_volume, color=divide)
radius_corner_fold = DoubleInput(0.03)
stirrup_radius_m = Formula("3/8*2.54*0.01*0.5;")
circular_stirrups_columns = Python(IN[0]=radius_corner_fold, IN[1]=column_dimensions, IN[2]=column_location, IN[3]=number_of_rebars_of_each_column_2, IN[4]=transpose_2, IN[5]=stirrup_radius_m)  # IronPython2
# ---------- circular_stirrups_columns.python (169 lines) ----------
# Carga las bibliotecas de DesignScript y normas de Python.
import sys
import clr
clr.AddReference('ProtoGeometry')
from Autodesk.DesignScript.Geometry import *

# INPUT 
dataEnteringNode = IN

rd=IN[0]
basic_data=IN[1]
ejes = IN[2]
nbars_col=IN[3]
typeRebar=IN[4]
rest=IN[5]

dbe=2*rest*100
availableRebar=[[4,1.27,1.266768698],
				[5,1.5875,1.97932609],
				[6,1.905,2.85022957],
				[8,2.54,5.067074791],
				[9,2.8575,6.413016532],
				[10,3.175,7.917304361],
				[12,3.81,11.40091828]]
# Incluya el código debajo de esta línea
sep1=[]
sep2=[]
hone=[]
ne=len(basic_data)
sumnbars=0
for i in range(0,ne):
	nbars=nbars_col[i][0]
	H=basic_data[i][1]
	diam=basic_data[i][0]
	dbmaxi=0
	
	# To determine the max rebar diameter on each
	# column - since the module numpy has not been imported
	for mri in range(sumnbars,sumnbars+nbars):
		if typeRebar[mri][0]>=dbmaxi:
			dbmaxi=typeRebar[mri][0]
			
	db=availableRebar[dbmaxi-1][1]
	
	s1=min(diam/4,6*db)
	s1=min(s1,10)
	
	s2=min(850*db,480*dbe)
	s2=min(s2,diam/2)
	
	sep1.append(s1)
	sep2.append(s2)

	h1=max(diam/0.4,H/6)
	h1=max(h1,60)
	
	hone.append(h1)
	
	sumnbars=sumnbars+nbars
# The z coordinate location of each stirrup is to be computed
# along each column's length

z=[]
for i in range(0,ne):
	z0=5 # This is the lowest local level of a stirrup in a column 
	ze=[]
	j=0
	while z0<float(hone[i]):
		ze.append(z0)
		z0=z0+sep1[i]
		j=j+1
		
	k=0
	while z0<float(H-hone[i]):
		ze.append(z0)
		z0=z0+sep2[i]
		k=k+1
	
	j=0
	while z0<float(H):
		ze.append(z0)
		z0=z0+sep1[i]
		j=j+1
		
	z.append(ze)
	

n_elementos = len(ejes)

lista_x = []
lista_y = []
list_zc = []
list_points_cols = []
for j in range(0, n_elementos):
	ne = len(z[j])
	
	x1 = ejes[j][0]
	lista_x.append(x1)
	y1 = ejes[j][1]
	lista_y.append(y1)
	
	list_points = []
	list_z = []
	for i in range(0, ne):
	    ze = z[j][i] + ejes[j][2]
	    list_z.append(ze)
	    p = Point.ByCoordinates(x1, y1, ze*0.01)
	    list_points.append(p)
	    
	list_zc.append(list_z)

	list_points_cols.append(list_points)
    

centro_0=list_zc
centro_1=lista_x
centro_2=lista_y

rc=basic_data
rv=rest

# Hook length (according to the stirrup's radius)
dstirrup=2*rv
ganchos=max(6*dstirrup,0.08)

lista_dobleces=[]
lista_mangas_uno=[]
lista_mangas_dos=[]
lista_estribos=[]

list_axis_origin=[]
nelem=len(centro_2)
for j in range(0,nelem):
	re=rc[j][0]*0.01*0.5-rc[j][2]*0.01+2*rv
	
	x=centro_1[j]*0.01
	y=centro_2[j]*0.01
	ne=len(centro_0[j])
	for i in range(0,ne):
		# to revolve the stirrup__________________________________________
		z=centro_0[j][i]*0.01
		p=Point.ByCoordinates(x,re+y,z)
		n=Vector.ByCoordinates(1,0,0)
		e=Circle.ByCenterPointRadiusNormal(p,rv,n)
		axisOrigin = Point.ByCoordinates(x, y, z)
		#axisOrigin=centro[3][j][i]
		axisDir=Vector.ByCoordinates(0,0,1)
		estribo=Solid.ByRevolve(e,axisOrigin,axisDir,0,360)
		lista_estribos.append(estribo)
		
		# to create the hook______________________________________________
		c=Point.ByCoordinates(rd+x,(re-rd)+y,z)
		n=Vector.ByCoordinates(0,1,0)
		doblez=Circle.ByCenterPointRadiusNormal(c,rv,n)
		axisOrigin=Point.ByCoordinates(x,re-rd+y,z)
		axisDir=Vector.ByCoordinates(0,0,1)
		d=Solid.ByRevolve(doblez,axisOrigin,axisDir,0,180)
		lista_dobleces.append(d)
		
		# folding stirrups' length________________________________________
		manga_uno=Curve.ExtrudeAsSolid(doblez,Vector.ByCoordinates(0,-1,0),ganchos)
		lista_mangas_uno.append(manga_uno)
		
		c=Point.ByCoordinates(-rd+x,(re-rd)+y,z)
		doblez=Circle.ByCenterPointRadiusNormal(c,rv,n)
		manga_dos=Curve.ExtrudeAsSolid(doblez,Vector.ByCoordinates(0,-1,0),ganchos)
		lista_mangas_dos.append(manga_dos)
	
OUT = [lista_estribos,lista_dobleces,lista_mangas_uno,lista_mangas_dos]
# ----------------------------------------
color_palette_3 = ColorPalette({R: 255, G: 0, B: 255, A: 255})
byGeometryColor_3 = Modifiers.GeometryColor.ByGeometryColor(geometry=circular_stirrups_columns, color=color_palette_3)
