# Dynamo graph RebarPlaneFramesBCIF.dyn (Dynamo 2.10.1.3976)

# group: Reinforced concrete plane frames - Composed by rectangular beams, rectangular columns and rectangular isolated footings
radius_corner_fold = DoubleInput(0.02)
stirrup_radius_m = Formula("3/8*2.54*0.01*0.5;")
file_path = Filename("..\..\..\..\..\..\..\DynamoRevit\Dynamo_visualization\shear_beam_design.csv")  # graph input
importCSV = Data.ImportCSV(filePath=file_path)
transpose = List.Transpose(lists=importCSV)
file_path_2 = Filename("..\..\..\..\..\..\..\DynamoRevit\Dynamo_visualization\dim_beams_collection.csv")  # graph input
importCSV_2 = Data.ImportCSV(filePath=file_path_2)
transpose_2 = List.Transpose(lists=importCSV_2)
file_path_3 = Filename("..\..\..\..\..\..\..\DynamoRevit\Dynamo_visualization\coord_begin_beams.csv")  # graph input
importCSV_3 = Data.ImportCSV(filePath=file_path_3)
transpose_3 = List.Transpose(lists=importCSV_3)
rectangular_stirrups_in_beams = Python(IN[0]=radius_corner_fold, IN[1]=stirrup_radius_m, IN[2]=transpose, IN[3]=transpose_2, IN[4]=transpose_3)  # IronPython2
# ---------- rectangular_stirrups_in_beams.python (190 lines) ----------
# MAIN PROGRAM -----------------------------------------------------------
# Load libraries
import sys
import clr

clr.AddReference('ProtoGeometry')
from Autodesk.DesignScript.Geometry import *

# The inputs to this node will be stored as a list in the IN variables.
dataEnteringNode = IN

# Assign your output to the OUT variable.

rd=IN[0]
rv=IN[1]
shear_design = IN[2]
basic = IN[3]
ejes = IN[4]

nbeams=len(shear_design)

lista_x = []
lista_y = []
lista_z = []
for i in range(0,nbeams):
	
	s1=shear_design[i][0]
	s2=shear_design[i][1]
	s3=shear_design[i][2]
	
	d1=shear_design[i][3]
	d2=shear_design[i][4]
	
	span=basic[i][2]
	
	# The y coordinate location of each stirrup is to be computed
	# along each beam's length

	y0=5 # This is the lowest local level of a stirrup in a column 
	ye=[]
	j=0
	while y0<float(d1):
		y00=y0+ejes[i][1]
		ye.append(y00)
		y0=y0+s1
		j=j+1
	
	if (d1+d2)!=span:
		k=0
		while y0<float(span-d2):
			y00=y0+ejes[i][1]
			ye.append(y00)
			y0=y0+s2
			k=k+1
	
	n=0
	while y0<float(span):
		y00=y0+ejes[i][1]
		ye.append(y00)
		y0=y0+s3
		n=n+1
		
	lista_y.append(ye)
	
	x1 = ejes[i][0]*0.01
	lista_x.append(x1)
	z1 = ejes[i][2]*0.01
	lista_z.append(z1)
		
    
centro_0=lista_z
centro_1=lista_x
centro_2=lista_y

basicos=basic

## Hook length
db=2*rv
lga=max(6*db,0.08)

lista_dobleces=[]
lista_ld=[]

nelem=len(centro_0)
for j in range(0,nelem):
	ne=len(centro_2[j])
	b=basicos[j][0]*0.01
	h=basicos[j][1]*0.01
	rec=basicos[j][3]*0.01;
	bp=b-2*rec
	hp=h-2*rec
	xa=centro_1[j]
	za=centro_0[j]
	x=xa+bp*0.5
	z=za-0.5*hp-rd
	for i in range(0,ne):
		y=centro_2[j][i]*0.01
		# lower-right corner -------------------------------------------
		esq=Point.ByCoordinates(x,y,z)
		n=Vector.ByCoordinates(1,0,0)
		e=Circle.ByCenterPointRadiusNormal(esq,rv,n)
		axisOrigin=Point.ByCoordinates(x,y,z+rd)
		axisDir=Vector.ByCoordinates(0,-1,0)
		doblez=Solid.ByRevolve(e,axisOrigin,axisDir,0,90)
		lista_dobleces.append(doblez)
		
		# right side ---------------------------------------------------
		cld=Circle.ByCenterPointRadiusNormal(Point.ByCoordinates(x+rd,y,z+rd),rv,Vector.ByCoordinates(0,0,1))
		ld=Curve.Extrude(cld,Vector.ByCoordinates(0,0,1),hp)
		lista_ld.append(ld)
		
		# top right corner ---------------------------------------------
		esq=Point.ByCoordinates(x+rd,y,hp+rd+z)
		n=Vector.ByCoordinates(0,0,1)
		e=Circle.ByCenterPointRadiusNormal(esq,rv,n)
		axisOrigin=Point.ByCoordinates(x,y,z+hp+rd)
		axisDir=Vector.ByCoordinates(0,-1,0)
		doblez=Solid.ByRevolve(e,axisOrigin,axisDir,0,90)
		lista_dobleces.append(doblez)

		# top side -----------------------------------------------------
		cld=Circle.ByCenterPointRadiusNormal(Point.ByCoordinates(x,y,hp+2*rd+z),rv,Vector.ByCoordinates(1,0,0))
		ld=Curve.Extrude(cld,Vector.ByCoordinates(-1,0,0),bp)
		lista_ld.append(ld)
		
		# top left corner ----------------------------------------------
		esq=Point.ByCoordinates(-bp+x,y,hp+2*rd+z)
		n=Vector.ByCoordinates(1,0,0)
		e=Circle.ByCenterPointRadiusNormal(esq,rv,n)
		axisOrigin=Point.ByCoordinates(-bp+x,y,hp+z+rd)
		axisDir=Vector.ByCoordinates(0,-1,0)
		doblez=Solid.ByRevolve(e,axisOrigin,axisDir,0,90)
		lista_dobleces.append(doblez)
		
		# left side ----------------------------------------------------
		cld=Circle.ByCenterPointRadiusNormal(Point.ByCoordinates(x-bp-rd,y,hp+z+rd),rv,Vector.ByCoordinates(0,0,1))
		ld=Curve.Extrude(cld,Vector.ByCoordinates(0,2*rv/(hp),-1),hp)
		lista_ld.append(ld)
		
		# lower left corner ---------------------------------------------
		esq=Point.ByCoordinates(-bp+x-rd,y+2*rv,z+rd)
		n=Vector.ByCoordinates(0,0,1)
		e=Circle.ByCenterPointRadiusNormal(esq,rv,n)
		axisOrigin=Point.ByCoordinates(-bp+x,y+2*rv,z+rd)
		axisDir=Vector.ByCoordinates(0,-1,0)
		doblez=Solid.ByRevolve(e,axisOrigin,axisDir,0,90)
		lista_dobleces.append(doblez)
		
		# lower side ----------------------------------------------------
		
		cld=Circle.ByCenterPointRadiusNormal(Point.ByCoordinates(x-bp,y+2*rv,z),rv,Vector.ByCoordinates(1,0,0))
		ld=Curve.Extrude(cld,Vector.ByCoordinates(1,0,0),bp)
		lista_ld.append(ld)
		
		# outer lower right corner
		esq=Point.ByCoordinates(x,y+2*rv,z)
		n=Vector.ByCoordinates(1,0,0)
		e=Circle.ByCenterPointRadiusNormal(esq,rv,n)
		axisOrigin=Point.ByCoordinates(x,y+2*rv,z+rd)
		axisDir=Vector.ByCoordinates(0,-1,0)
		doblez=Solid.ByRevolve(e,axisOrigin,axisDir,0,90)
		lista_dobleces.append(doblez)
		
		# right hook ----------------------------------------------------
		esq=Point.ByCoordinates(x+rd,2*rv+y,z+rd)
		n=Vector.ByCoordinates(0,0,1)
		e=Circle.ByCenterPointRadiusNormal(esq,rv,n)
		axisOrigin=Point.ByCoordinates(x,y+2*rv,z+rd)
		axisDir=Vector.ByCoordinates(0,-1,0)
		doblez=Solid.ByRevolve(e,axisOrigin,axisDir,0,45)
		lista_dobleces.append(doblez)
		
		lg=Circle.ByCenterPointRadiusNormal(Point.ByCoordinates(0.7071*rd+x,y+2*rv,z+1.7071*rd),rv,Vector.ByCoordinates(-1,0,1))
		ld=Curve.Extrude(lg,Vector.ByCoordinates(-1,0,1),lga)
		lista_ld.append(ld)
		
		# left hook ----------------------------------------------------
		esq=Point.ByCoordinates(x,y,z)
		n=Vector.ByCoordinates(-1,0,0)
		e=Circle.ByCenterPointRadiusNormal(esq,rv,n)
		axisOrigin=Point.ByCoordinates(x,y,z+rd)
		axisDir=Vector.ByCoordinates(0,-1,0)
		doblez=Solid.ByRevolve(e,axisOrigin,axisDir,0,-45)
		lista_dobleces.append(doblez)
		
		lg=Circle.ByCenterPointRadiusNormal(Point.ByCoordinates(-0.7071*rd+x,y,z+(1-0.7071)*rd),rv,Vector.ByCoordinates(-1,0,1))
		ld=Curve.Extrude(lg,Vector.ByCoordinates(-1,0,1),lga)
		lista_ld.append(ld)
		
OUT = [lista_ld,lista_dobleces]
# ----------------------------------------
color_palette = ColorPalette({R: 127, G: 255, B: 0, A: 255})
byGeometryColor = Modifiers.GeometryColor.ByGeometryColor(geometry=rectangular_stirrups_in_beams, color=color_palette)
file_path_4 = Filename("..\..\..\..\..\..\..\DynamoRevit\Dynamo_visualization\collection_type_bar_beams.csv")  # graph input
importCSV_4 = Data.ImportCSV(filePath=file_path_4)
transpose_4 = List.Transpose(lists=importCSV_4)
file_path_5 = Filename("..\..\..\..\..\..\..\DynamoRevit\Dynamo_visualization\nrebar_beams_collection.csv")  # graph input
importCSV_5 = Data.ImportCSV(filePath=file_path_5)
transpose_5 = List.Transpose(lists=importCSV_5)
file_path_6 = Filename("..\..\..\..\..\..\..\DynamoRevit\Dynamo_visualization\collection_disposition_rebar_beams3sec.csv")  # graph input
importCSV_6 = Data.ImportCSV(filePath=file_path_6)
transpose_6 = List.Transpose(lists=importCSV_6)
longitudinal_rebar_beams = Python(IN[0]=transpose_2, IN[1]=transpose_3, IN[2]=transpose_4, IN[3]=transpose_5, IN[4]=transpose_6)  # IronPython2
# ---------- longitudinal_rebar_beams.python (60 lines) ----------
import clr
clr.AddReference('ProtoGeometry')
from Autodesk.DesignScript.Geometry import *
dataEnteringNode = IN

list_bars=[]

basic_beams=IN[0]
coordenadas_beam=IN[1]
tipovar=IN[2]
nbars_beam=IN[3]
coord_varillas=IN[4]

availableRebar=[[4,1.27,1.266768698],
				[5,1.5875,1.97932609],
				[6,1.905,2.85022957],
				[8,2.54,5.067074791],
				[9,2.8575,6.413016532],
				[10,3.175,7.917304361],
				[12,3.81,11.40091828]]

nbeams=len(coordenadas_beam)
sumanv_beam=0
nvar=0
points_collec=[]
for i in range(0,nbeams):
		
	span=basic_beams[i][2]*0.01
	for j in range(0,6):
		if j==0 or j==1:
			sec=0
		elif j==2 or j==3:
			sec=1
		elif j==4 or j==5:
			sec=2
			
		nvar=nvar+nbars_beam[i][j]
		for k in range(int(sumanv_beam),int(nvar)):
			index_bar=tipovar[k][0]
			diam_bar=availableRebar[index_bar-1][1]
			rvar=diam_bar*0.01*0.5
			
			xvar=coord_varillas[k][0]*0.01+coordenadas_beam[i][0]*0.01
			zvar=coord_varillas[k][1]*0.01+coordenadas_beam[i][2]*0.01
	
			center_point=Point.ByCoordinates(xvar,coordenadas_beam[i][1]*0.01+sec*0.333*span,zvar)
			
			points_collec.append(center_point)
			myColCirc=Circle.ByCenterPointRadiusNormal(center_point,rvar,Vector.ByCoordinates(0,1,0))
			
			pbeam=Curve.Extrude(myColCirc,Vector.ByCoordinates(0,1,0),span*0.333)
			
			list_bars.append(pbeam)
		
		sumanv_beam=sumanv_beam+nbars_beam[i][j]
		
	
#OUT=list_bars
#OUT=points_collec
OUT=list_bars
# ----------------------------------------
color_palette_2 = ColorPalette({R: 0, G: 255, B: 255, A: 255})
byGeometryColor_2 = Modifiers.GeometryColor.ByGeometryColor(geometry=longitudinal_rebar_beams, color=color_palette_2)
file_path_7 = Filename("..\..\..\..\..\..\..\DynamoRevit\Dynamo_visualization\dim_footings_collection.csv")  # graph input
importCSV_7 = Data.ImportCSV(filePath=file_path_7)
transpose_7 = List.Transpose(lists=importCSV_7)
file_path_8 = Filename("..\..\..\..\..\..\..\DynamoRevit\Dynamo_visualization\coord_base_footings.csv")  # graph input
importCSV_8 = Data.ImportCSV(filePath=file_path_8)
transpose_8 = List.Transpose(lists=importCSV_8)
file_path_9 = Filename("..\..\..\..\..\..\..\DynamoRevit\Dynamo_visualization\nrebar_footings_collection.csv")  # graph input
importCSV_9 = Data.ImportCSV(filePath=file_path_9)
transpose_9 = List.Transpose(lists=importCSV_9)
file_path_10 = Filename("..\..\..\..\..\..\..\DynamoRevit\Dynamo_visualization\collection_disposition_rebar_footings.csv")  # graph input
importCSV_10 = Data.ImportCSV(filePath=file_path_10)
transpose_10 = List.Transpose(lists=importCSV_10)
file_path_11 = Filename("..\..\..\..\..\..\..\DynamoRevit\Dynamo_visualization\collection_type_bar_footings.csv")  # graph input
importCSV_11 = Data.ImportCSV(filePath=file_path_11)
transpose_11 = List.Transpose(lists=importCSV_11)
rebar_isolated_footings = Python(IN[0]=transpose_7, IN[1]=transpose_8, IN[2]=transpose_9, IN[3]=transpose_10, IN[4]=transpose_11)  # IronPython2
# ---------- rebar_isolated_footings.python (75 lines) ----------
import clr
clr.AddReference('ProtoGeometry')
from Autodesk.DesignScript.Geometry import *
dataEnteringNode = IN

list_bars=[]

basic_foot=IN[0]
coordenadas_foot=IN[1]
nbars_foot=IN[2]
coord_varillas=IN[3]
tipovar=IN[4]


availableRebar=[[4,1.27,1.266768698],
				[5,1.5875,1.97932609],
				[6,1.905,2.85022957],
				[8,2.54,5.067074791],
				[9,2.8575,6.413016532],
				[10,3.175,7.917304361],
				[12,3.81,11.40091828]]

nfootings=len(coordenadas_foot)
sumanv_foot=0
nvar=0
points_collec=[]
span_collec=[]
for i in range(0,nfootings):
	span=basic_foot[i][0]*0.01
	for j in range(0,2): # rebar over the L section
		
		nvar=nvar+nbars_foot[i][j]
		for k in range(int(sumanv_foot),int(nvar)):
			index_bar=tipovar[k][0]
			diam_bar=availableRebar[index_bar-1][1]
			rvar=diam_bar*0.01*0.5
			
			xvar=coord_varillas[k][0]*0.01+coordenadas_foot[i][0]*0.01
			zvar=coord_varillas[k][1]*0.01+coordenadas_foot[i][2]*0.01
	
			center_point=Point.ByCoordinates(xvar,coordenadas_foot[i][1]*0.01-0.5*span,zvar)
			
			points_collec.append(center_point)
			myColCirc=Circle.ByCenterPointRadiusNormal(center_point,rvar,Vector.ByCoordinates(0,1,0))
			
			pfoot=Curve.Extrude(myColCirc,Vector.ByCoordinates(0,1,0),span)
			
			list_bars.append(pfoot)
			
		sumanv_foot=sumanv_foot+nbars_foot[i][j]
		
	span=basic_foot[i][1]*0.01
	for j in range(2,4): # rebar over the B section
		
		nvar=nvar+nbars_foot[i][j]
		for k in range(int(sumanv_foot),int(nvar)):
			index_bar=tipovar[k][0]
			diam_bar=availableRebar[index_bar-1][1]
			rvar=diam_bar*0.01*0.5
			
			yvar=coord_varillas[k][0]*0.01+coordenadas_foot[i][1]*0.01
			zvar=coord_varillas[k][1]*0.01+coordenadas_foot[i][2]*0.01
	
			center_point=Point.ByCoordinates(coordenadas_foot[i][0]*0.01-0.5*span,yvar,zvar)
			
			points_collec.append(center_point)
			myColCirc=Circle.ByCenterPointRadiusNormal(center_point,rvar,Vector.ByCoordinates(1,0,0))
			
			pfoot=Curve.Extrude(myColCirc,Vector.ByCoordinates(1,0,0),span)
			
			list_bars.append(pfoot)
			
		sumanv_foot=sumanv_foot+nbars_foot[i][j]
	
OUT=list_bars
# ----------------------------------------
color_palette_3 = ColorPalette({R: 255, G: 0, B: 0, A: 255})
byGeometryColor_3 = Modifiers.GeometryColor.ByGeometryColor(geometry=rebar_isolated_footings, color=color_palette_3)
beams_concrete = Python(IN[0]=transpose_2, IN[1]=transpose_3)  # IronPython2
# ---------- beams_concrete.python (33 lines) ----------
import clr
clr.AddReference('ProtoGeometry')
from Autodesk.DesignScript.Geometry import *
dataEnteringNode = IN

list_beams=[]

basic_beams=IN[0]
coordenadas_beam=IN[1]

nbeams=len(coordenadas_beam)
for i in range(0,nbeams):
		
	span=basic_beams[i][2]*0.01
	b=float(basic_beams[i][0])*0.01
	h=float(basic_beams[i][1])*0.01
	
	xb=coordenadas_beam[i][0]*0.01
	yb=coordenadas_beam[i][1]*0.01
	zb=coordenadas_beam[i][2]*0.01
	
	pr1=Point.ByCoordinates(xb-0.5*b,yb,zb+0.5*h)	
	pr2=Point.ByCoordinates(xb+0.5*b,yb,zb+0.5*h)
	pr3=Point.ByCoordinates(xb+0.5*b,yb,zb-0.5*h)
	pr4=Point.ByCoordinates(xb-0.5*b,yb,zb-0.5*h)
	
	mybeamRec=Rectangle.ByCornerPoints(pr1,pr2,pr3,pr4)	
	pbeam=Curve.Extrude(mybeamRec,Vector.ByCoordinates(0,1,0),span)
	
			
	list_beams.append(pbeam)
		
OUT=list_beams
# ----------------------------------------
color_palette_4 = ColorPalette({R: 255, G: 182, B: 193, A: 255})
number_slider = DoubleSlider(3.2, range=1..10 step 0.1)
divide = Color.Divide(c1=color_palette_4, div=number_slider)
byGeometryColor_4 = Modifiers.GeometryColor.ByGeometryColor(geometry=beams_concrete, color=divide)
isolated_footings_concrete = Python(IN[0]=transpose_7, IN[1]=transpose_8)  # IronPython2
# ---------- isolated_footings_concrete.python (32 lines) ----------
import clr
clr.AddReference('ProtoGeometry')
from Autodesk.DesignScript.Geometry import *
dataEnteringNode = IN

list_foot=[]

basic_foot=IN[0]
coordenadas_foot=IN[1]

nfootings=len(coordenadas_foot)
for i in range(0,nfootings):
	span=basic_foot[i][0]*0.01
	b=basic_foot[i][1]*0.01
	h=basic_foot[i][2]*0.01
	
	xf=coordenadas_foot[i][0]*0.01
	yf=coordenadas_foot[i][1]*0.01
	zf=coordenadas_foot[i][2]*0.01
	
	pf1=Point.ByCoordinates(xf-0.5*b,yf-0.5*span,zf+0.5*h)
	pf2=Point.ByCoordinates(xf+0.5*b,yf-0.5*span,zf+0.5*h)
	pf3=Point.ByCoordinates(xf+0.5*b,yf-0.5*span,zf-0.5*h)
	pf4=Point.ByCoordinates(xf-0.5*b,yf-0.5*span,zf-0.5*h)

	myFootRec=Rectangle.ByCornerPoints(pf1,pf2,pf3,pf4)
	pfoot=Curve.Extrude(myFootRec,Vector.ByCoordinates(0,1,0),span)
			
	list_foot.append(pfoot)
			
		
OUT=list_foot
# ----------------------------------------
color_palette_5 = ColorPalette({R: 255, G: 127, B: 80, A: 255})
number_slider_2 = DoubleSlider(3.2, range=1..10 step 0.1)
divide_2 = Color.Divide(c1=color_palette_5, div=number_slider_2)
byGeometryColor_5 = Modifiers.GeometryColor.ByGeometryColor(geometry=isolated_footings_concrete, color=divide_2)
file_path_12 = Filename("..\..\..\..\..\..\..\DynamoRevit\Dynamo_visualization\coord_base_columns.csv")  # graph input
importCSV_12 = Data.ImportCSV(filePath=file_path_12)
transpose_12 = List.Transpose(lists=importCSV_12)
file_path_13 = Filename("..\..\..\..\..\..\..\DynamoRevit\Dynamo_visualization\dim_cols_collection.csv")  # graph input
importCSV_13 = Data.ImportCSV(filePath=file_path_13)
transpose_13 = List.Transpose(lists=importCSV_13)
file_path_14 = Filename("..\..\..\..\..\..\..\DynamoRevit\Dynamo_visualization\nrebar_cols_collection.csv")  # graph input
importCSV_14 = Data.ImportCSV(filePath=file_path_14)
transpose_14 = List.Transpose(lists=importCSV_14)
file_path_15 = Filename("..\..\..\..\..\..\..\DynamoRevit\Dynamo_visualization\collection_type_bar_cols.csv")  # graph input
importCSV_15 = Data.ImportCSV(filePath=file_path_15)
transpose_15 = List.Transpose(lists=importCSV_15)
stirrup_radius_m_2 = Formula("3/8*2.54*0.01*0.5;")
radius_corner_fold_m = DoubleInput(0.03)
rectangular_stirrups_columns = Python(IN[0]=transpose_12, IN[1]=transpose_13, IN[2]=transpose_14, IN[3]=transpose_15, IN[4]=stirrup_radius_m_2, IN[5]=radius_corner_fold_m)  # IronPython2
# ---------- rectangular_stirrups_columns.python (240 lines) ----------
# MAIN PROGRAM -----------------------------------------------------------
# Load libraries
import sys
import clr
clr.AddReference('ProtoGeometry')
from Autodesk.DesignScript.Geometry import *

# INPUT 
dataEnteringNode = IN

ejes = IN[0]
basic_data=IN[1]
nbars_col=IN[2]
typeRebar=IN[3]
rest=IN[4]
rd=IN[5]

dbe=2*rest*100
availableRebar=[[4,1.27,1.266768698],
				[5,1.5875,1.97932609],
				[6,1.905,2.85022957],
				[8,2.54,5.067074791],
				[9,2.8575,6.413016532],
				[10,3.175,7.917304361],
				[12,3.81,11.40091828]]
# Incluya el código debajo de esta línea
sep1=[]
sep2=[]
hone=[]
ne=len(basic_data)
sumnbars=0
H_list=[]
for i in range(0,ne):
	nbars=nbars_col[i][0]
	H=basic_data[i][2]
	H_list.append(H)
	b=basic_data[i][0]
	dbmaxi=0
	
	# To determine the max rebar diameter on each
	# column - since the module numpy has not been imported
	for mri in range(sumnbars,sumnbars+nbars):
		if typeRebar[mri][0]>=dbmaxi:
			dbmaxi=typeRebar[mri][0]
			
	db=availableRebar[dbmaxi-1][1]
	
	s1=min(b/4,6*db)
	s1=min(s1,10)
	
	s2=min(850*db,480*dbe)
	s2=min(s2,b/2)
	
	sep1.append(s1)
	sep2.append(s2)

	h1=max(b/0.4,H/6)
	h1=max(h1,60)
	
	hone.append(h1)
	
	sumnbars=sumnbars+nbars
# The z coordinate location of each stirrup is to be computed
# along each column's length

z=[]
for i in range(0,ne):
	z0=5 # This is the lowest local level of a stirrup in a column 
	ze=[]
	j=0
	while z0<float(hone[i]):
		ze.append(z0)
		z0=z0+sep1[i]
		j=j+1
		
	k=0
	while z0<float(H_list[i]-hone[i]):
		ze.append(z0)
		z0=z0+sep2[i]
		k=k+1
	
	j=0
	while z0<float(H_list[i]):
		ze.append(z0)
		z0=z0+sep1[i]
		j=j+1
		
	z.append(ze)
	
# The global location of each stirrup is now computed:

n_elementos = len(ejes)

lista_x = []
lista_y = []
list_zc = []
list_points_cols = []
for j in range(0, n_elementos):
	ne = len(z[j])
	
	x1 = ejes[j][0]
	lista_x.append(x1)
	y1 = ejes[j][1]
	lista_y.append(y1)
	
	list_points = []
	list_z = []
	for i in range(0, ne):
	    ze = z[j][i] + ejes[j][2]
	    list_z.append(ze)
	    p = Point.ByCoordinates(x1, y1, ze*0.01)
	    list_points.append(p)
	    
	list_zc.append(list_z)

	list_points_cols.append(list_points)
    
# Now, each stirrup for each column is generated as a solid

centro_0=list_zc
centro_1=lista_x
centro_2=lista_y

basicos=basic_data
rv=rest

# Hook length (according to the stirrup's radius)
dstirrup=2*rv
lga=max(6*dstirrup,0.08)

lista_dobleces=[]
lista_ld=[]

nelem=len(centro_2)
for j in range(0,nelem):
	ne=len(centro_0[j])
	b=basicos[j][0]*0.01
	h=basicos[j][1]*0.01
	rec=basicos[j][3]*0.01;
	bp=b-2*rec-rd
	hp=h-2*rec-rd
	xa=centro_1[j]*0.01
	ya=centro_2[j]*0.01
	x=xa+bp*0.5
	y=ya-0.5*hp-rd
	for i in range(0,ne):
		z=centro_0[j][i]*0.01
		# lower-right corner -------------------------------------------
		esq=Point.ByCoordinates(x,y,z)
		n=Vector.ByCoordinates(1,0,0)
		e=Circle.ByCenterPointRadiusNormal(esq,rv,n)
	
		axisOrigin=Point.ByCoordinates(x,y+rd,z)
		axisDir=Vector.ByCoordinates(0,0,1)
		doblez=Solid.ByRevolve(e,axisOrigin,axisDir,0,90)
		lista_dobleces.append(doblez)
		
		# right side ---------------------------------------------------
		cld=Circle.ByCenterPointRadiusNormal(Point.ByCoordinates(x+rd,y+rd,z),rv,Vector.ByCoordinates(0,1,0))
		ld=Curve.Extrude(cld,Vector.ByCoordinates(0,1,0),hp)
		lista_ld.append(ld)
		
		# top right corner ---------------------------------------------
		esq=Point.ByCoordinates(x+rd,hp+rd+y,z)
		n=Vector.ByCoordinates(0,1,0)
		e=Circle.ByCenterPointRadiusNormal(esq,rv,n)
		axisOrigin=Point.ByCoordinates(x,hp+rd+y,z)
		axisDir=Vector.ByCoordinates(0,0,1)
		doblez=Solid.ByRevolve(e,axisOrigin,axisDir,0,90)
		lista_dobleces.append(doblez)
		
		# top side -----------------------------------------------------
		cld=Circle.ByCenterPointRadiusNormal(Point.ByCoordinates(x,hp+2*rd+y,z),rv,Vector.ByCoordinates(1,0,0))
		ld=Curve.Extrude(cld,Vector.ByCoordinates(-1,0,0),bp)
		lista_ld.append(ld)
		
		# top left corner ----------------------------------------------
		esq=Point.ByCoordinates(-bp+x,hp+2*rd+y,z)
		n=Vector.ByCoordinates(1,0,0)
		e=Circle.ByCenterPointRadiusNormal(esq,rv,n)
		axisOrigin=Point.ByCoordinates(-bp+x,hp+rd+y,z)
		axisDir=Vector.ByCoordinates(0,0,1)
		doblez=Solid.ByRevolve(e,axisOrigin,axisDir,0,90)
		lista_dobleces.append(doblez)
		
		# left side ----------------------------------------------------
		cld=Circle.ByCenterPointRadiusNormal(Point.ByCoordinates(x-bp-rd,rd+hp+y,z),rv,Vector.ByCoordinates(0,1,0))
		ld=Curve.Extrude(cld,Vector.ByCoordinates(0,-1,2*rv/hp),hp)
		lista_ld.append(ld)
		
		# lower left corner ---------------------------------------------
		esq=Point.ByCoordinates(-bp+x-rd,rd+y,z+2*rv)
		n=Vector.ByCoordinates(0,1,0)
		e=Circle.ByCenterPointRadiusNormal(esq,rv,n)
		axisOrigin=Point.ByCoordinates(-bp+x,rd+y,z+2*rv)
		axisDir=Vector.ByCoordinates(0,0,1)
		doblez=Solid.ByRevolve(e,axisOrigin,axisDir,0,90)
		lista_dobleces.append(doblez)
		
		# lower side ----------------------------------------------------
		cld=Circle.ByCenterPointRadiusNormal(Point.ByCoordinates(x-bp,y,z+2*rv),rv,Vector.ByCoordinates(1,0,0))
		ld=Curve.Extrude(cld,Vector.ByCoordinates(1,0,0),bp)
		lista_ld.append(ld)
		
		# outer lower right corner
		esq=Point.ByCoordinates(x,y,z+2*rv)
		n=Vector.ByCoordinates(1,0,0)
		e=Circle.ByCenterPointRadiusNormal(esq,rv,n)
		axisOrigin=Point.ByCoordinates(x,y+rd,z+2*rv)
		axisDir=Vector.ByCoordinates(0,0,1)
		doblez=Solid.ByRevolve(e,axisOrigin,axisDir,0,90)
		lista_dobleces.append(doblez)
		
		# right hook ----------------------------------------------------
		esq=Point.ByCoordinates(x+rd,rd+y,z+2*rv)
		n=Vector.ByCoordinates(0,1,0)
		e=Circle.ByCenterPointRadiusNormal(esq,rv,n)
		axisOrigin=Point.ByCoordinates(x,rd+y,z+2*rv)
		axisDir=Vector.ByCoordinates(0,0,1)
		doblez=Solid.ByRevolve(e,axisOrigin,axisDir,0,45)
		lista_dobleces.append(doblez)
		
		lg=Circle.ByCenterPointRadiusNormal(Point.ByCoordinates(0.7071*rd+x,y+1.7071*rd,z+2*rv),rv,Vector.ByCoordinates(-1,1,0))
		ld=Curve.Extrude(lg,Vector.ByCoordinates(-1,1,0),lga)
		lista_ld.append(ld)
		
		# left hook ----------------------------------------------------
		esq=Point.ByCoordinates(x,y,z)
		n=Vector.ByCoordinates(-1,0,0)
		e=Circle.ByCenterPointRadiusNormal(esq,rv,n)
		axisOrigin=Point.ByCoordinates(x,y+rd,z)
		axisDir=Vector.ByCoordinates(0,0,1)
		doblez=Solid.ByRevolve(e,axisOrigin,axisDir,0,-45)
		lista_dobleces.append(doblez)
		
		lg=Circle.ByCenterPointRadiusNormal(Point.ByCoordinates(-0.7071*rd+x,y+(1-0.7071)*rd,z),rv,Vector.ByCoordinates(-1,1,0))
		ld=Curve.Extrude(lg,Vector.ByCoordinates(-1,1,0),lga)
		lista_ld.append(ld)

OUT = [lista_ld,lista_dobleces]
# ----------------------------------------
color_palette_6 = ColorPalette({R: 255, G: 0, B: 255, A: 255})
byGeometryColor_6 = Modifiers.GeometryColor.ByGeometryColor(geometry=rectangular_stirrups_columns, color=color_palette_6)
file_path_16 = Filename("..\..\..\..\..\..\..\DynamoRevit\Dynamo_visualization\collection_disposition_rebar_cols.csv")  # graph input
importCSV_16 = Data.ImportCSV(filePath=file_path_16)
transpose_16 = List.Transpose(lists=importCSV_16)
longitudinal_rebar_columns = Python(IN[0]=transpose_12, IN[1]=transpose_13, IN[2]=transpose_14, IN[3]=transpose_15, IN[4]=transpose_16)  # IronPython2
# ---------- longitudinal_rebar_columns.python (45 lines) ----------
import clr
clr.AddReference('ProtoGeometry')
from Autodesk.DesignScript.Geometry import *
dataEnteringNode = IN

# INPUT
coord_col=IN[0]
basic=IN[1]
nbars_col=IN[2]
tipovar=IN[3]
coordbars=IN[4]

availableRebar=[[4,1.27,1.266768698],
				[5,1.5875,1.97932609],
				[6,1.905,2.85022957],
				[8,2.54,5.067074791],
				[9,2.8575,6.413016532],
				[10,3.175,7.917304361],
				[12,3.81,11.40091828]]
# MAIN LOOP
list_bars=[]
ncols=len(coord_col)
sumanv_col=0
nvar=0
for i in range(0,ncols):
	nvar=nvar+nbars_col[i][0]
	hc=float(basic[i][2])*0.01
	for b in range(0+int(sumanv_col),int(nvar)):
		xvar=coordbars[b][0]*0.01+float(coord_col[i][0])*0.01
		yvar=coordbars[b][1]*0.01+float(coord_col[i][1])*0.01
		
		tv=tipovar[b][0]-1
		typeRebar=availableRebar[tv][0]
		rvar=float(typeRebar)/8*2.54*0.01*0.5
		
		center_point=Point.ByCoordinates(xvar,yvar,float(coord_col[i][2])*0.01+0.5*hc)
		myColCirc=Circle.ByCenterPointRadius(center_point,rvar)
		psur=Surface.ByPatch(myColCirc)
		ptorre=Surface.Thicken(psur,hc)
		list_bars.append(ptorre)
		
	sumanv_col=sumanv_col+nbars_col[i][0]
		
	
OUT=list_bars
# ----------------------------------------
color_palette_7 = ColorPalette({R: 34, G: 139, B: 34, A: 255})
byGeometryColor_7 = Modifiers.GeometryColor.ByGeometryColor(geometry=longitudinal_rebar_columns, color=color_palette_7)
columns_volume = Python(IN[0]=transpose_13, IN[1]=transpose_12)  # IronPython2
# ---------- columns_volume.python (25 lines) ----------
import clr
clr.AddReference('ProtoGeometry')
from Autodesk.DesignScript.Geometry import *
dataEnteringNode = IN

# INPUT
basic=IN[0]
coord_col=IN[1]

# MAIN LOOP
list_cols=[]
ncols=len(coord_col)
for i in range(0,ncols):
	hc=float(basic[i][2])*0.01
	b=basic[i][0]*0.01
	h=basic[i][1]*0.01
	
	csAxis=CoordinateSystem.ByOrigin(coord_col[i][0]*0.01,coord_col[i][1]*0.01,coord_col[i][2]*0.01+0.5*hc)
	myColRec=Rectangle.ByWidthLength(csAxis,b,h)
	psur=Surface.ByPatch(myColRec)
	ptorre=Surface.Thicken(psur,hc)
	list_cols.append(ptorre)
		
	
OUT=list_cols
# ----------------------------------------
color_palette_8 = ColorPalette({R: 34, G: 139, B: 34, A: 255})
transparency_of_columns_concrete = DoubleSlider(3.2, range=1..10 step 0.1)
divide_3 = Color.Divide(c1=color_palette_8, div=transparency_of_columns_concrete)
byGeometryColor_8 = Modifiers.GeometryColor.ByGeometryColor(geometry=columns_volume, color=divide_3)
