# Dynamo graph ExtractFeaturesElmsModel2Excel.dyn (Dynamo 2.19.3.6394)
# packages: Structural Design 2024.4.15, MEPover 2020.6.2

select_model_elements = DSModelElementsSelection()  # 3 picked in the model; graph input
parameters = StructuralDesign.Model.Geometry.Parameters(element=select_model_elements)
python_script = Python()  # CPython3
# ---------- python_script.python (13 lines) ----------
# Carga las bibliotecas de DesignScript y normas de Python.
import sys
import clr
clr.AddReference('ProtoGeometry')
from Autodesk.DesignScript.Geometry import *

# Las entradas de este nodo se almacenan como lista en las variables IN.
dataEnteringNode = IN

# Incluya el código debajo de esta línea
k=round(2.289999,2)
# Asigne la salida a la variable OUT.
OUT = k
# ----------------------------------------
file_path = Filename("Design_Data\ElmsDataFromRevitMdel.xlsx")  # graph input
code_block = CodeBlock { "DataElms"; 0; 0; }
parameters_to_extract = CodeBlock { "Tipo"; "Familia"; }
boolean = BoolSelector(true)
getParameterAsValueString = Custom[GetParameterAsValueString](Elements=select_model_elements, ParameterName=parameters_to_extract.out0, Suffix=boolean)  # package MEPover; Returns the parameter values without conversion to the revit internal unit system. The suffix boolean toggles the project units on or off
element_dimensions = Python(IN[0]=getParameterAsValueString)  # CPython3
# ---------- element_dimensions.python (24 lines) ----------
# Carga las bibliotecas de DesignScript y normas de Python.
import sys
import clr
clr.AddReference('ProtoGeometry')
from Autodesk.DesignScript.Geometry import *

# Las entradas de este nodo se almacenan como lista en las variables IN.
dataEnteringNode = IN

# Incluya el código debajo de esta línea
typeElm=IN[0]

nb=len(typeElm)
bdim=[]
hdim=[]
for i in range(0,nb):
    bi=typeElm[i][0]+typeElm[i][1]+typeElm[i][2]
    hi=typeElm[i][6]+typeElm[i][7]+typeElm[i][8]
    
    bdim.append(int(bi))
    hdim.append(int(hi))
    
# Asigne la salida a la variable OUT.
OUT = [bdim,hdim]
# ----------------------------------------
getParameterAsValueString_2 = Custom[GetParameterAsValueString](Elements=select_model_elements, ParameterName=parameters_to_extract.out1, Suffix=boolean)
getLocation = Element.GetLocation(element=select_model_elements)
byJoinedCurves = PolyCurve.ByJoinedCurves(curves=getLocation)
points = PolyCurve.Points(polyCurve=byJoinedCurves)
X = Point.X(point=points)
Y = Point.Y(point=points)
Z = Point.Z(point=points)
length = Curve.Length(curve=getLocation)
features_elms = Python(IN[0]=element_dimensions, IN[1]=getParameterAsValueString_2, IN[2]=X, IN[3]=Y, IN[4]=Z, IN[5]=length)  # CPython3
# ---------- features_elms.python (29 lines) ----------
# Carga las bibliotecas de DesignScript y normas de Python.
import sys
import clr
clr.AddReference('ProtoGeometry')
from Autodesk.DesignScript.Geometry import *
import math as m
# Las entradas de este nodo se almacenan como lista en las variables IN.
dataEnteringNode = IN


# Las entradas de este nodo se almacenan como lista en las variables IN.
dataEnteringNode = IN
dimElms=IN[0]
famElms=IN[1]
locPointsx=IN[2]
locPointsy=IN[3]
locPointsz=IN[4]
lenElm=IN[5]

locPx=[]
locPy=[]
locPz=[]
nb=len(locPointsx)-1
locPxyzDim=[]
for i in range(0,nb):
    spanbi=m.sqrt((locPointsx[i+1]-locPointsx[i])**2+(locPointsy[i+1]-locPointsy[i])**2+(locPointsz[i+1]-locPointsz[i])**2)
    locPxyzDim.append([round(locPointsx[i],0),round(locPointsy[i],0),round(locPointsz[i],0),round(locPointsx[i+1],0),round(locPointsy[i+1],0),round(locPointsz[i+1],0),dimElms[0][i],dimElms[1][i],round(spanbi,0),famElms[i]])
    
OUT=locPxyzDim
# ----------------------------------------
exportToExcel = Data.ExportToExcel(filePath=file_path, sheetName=code_block.out0, startRow=code_block.out1, startColumn=code_block.out2, data=features_elms)
