# Dynamo graph MSCrankedBeamsRebar_Staircase.dyn "MSRecCranked_RecBeamsRebar_Staircase" (Dynamo 2.19.3.6394)
# packages: Structural Design 2023.4.25, Structural Design 2024.4.15, PracticalBIM 2020.0.43

file_path = Filename("Design_Data\RebarBeams\ShearBeamDesign.csv")
boolean = BoolSelector(true)
importCSV = Data.ImportCSV(filePath=file_path, transpose=boolean)
select_model_elements = DSModelElementsSelection()  # 3 picked in the model
getLocation = Element.GetLocation(element=select_model_elements)
byJoinedCurves = PolyCurve.ByJoinedCurves(curves=getLocation)
points = PolyCurve.Points(polyCurve=byJoinedCurves)
X = Point.X(point=points)
Y = Point.Y(point=points)
Z = Point.Z(point=points)
initial_point_locations_of_beam = Python(IN[0]=X, IN[1]=Y, IN[2]=Z)  # "Initial point locations of beam elements"; CPython3
# ---------- initial_point_locations_of_beam.python (27 lines) ----------
# Carga las bibliotecas de DesignScript y normas de Python.
import sys
import clr
clr.AddReference('ProtoGeometry')
from Autodesk.DesignScript.Geometry import *

# Las entradas de este nodo se almacenan como lista en las variables IN.
dataEnteringNode = IN


# Las entradas de este nodo se almacenan como lista en las variables IN.
dataEnteringNode = IN
locPointsx=IN[0]
locPointsy=IN[1]
locPointsz=IN[2]

locPx=[]
locPy=[]
locPz=[]
nb=len(locPointsx)-1
for i in range(0,nb):
    locPx.append(locPointsx[i])
    locPy.append(locPointsy[i])
    locPz.append(locPointsz[i])

# Asigne la salida a la variable OUT.
OUT = [locPx,locPy,locPz]
# ----------------------------------------
components_of_beams_axis = Python(IN[0]=points)  # "Components of beams' axis direction vectors"; CPython3
# ---------- components_of_beams_axis.python (21 lines) ----------
# Carga las bibliotecas de DesignScript y normas de Python.
import sys
import clr
clr.AddReference('ProtoGeometry')
from Autodesk.DesignScript.Geometry import *

# Las entradas de este nodo se almacenan como lista en las variables IN.
dataEnteringNode = IN
pif=IN[0]

nv=len(pif)-1
listV=[]
for i in range(0,nv):
    vdbi=Vector.ByTwoPoints(pif[i],pif[i+1])
    vdnbi=Vector.Normalized(vdbi)
    listV.append(vdnbi)



# Asigne la salida a la variable OUT.
OUT = listV
# ----------------------------------------
X_2 = Vector.X(vector=components_of_beams_axis)
Y_2 = Vector.Y(vector=components_of_beams_axis)
Z_2 = Vector.Z(vector=components_of_beams_axis)
components_of_beam_direction = Python(IN[0]=X_2, IN[1]=Y_2, IN[2]=Z_2)  # "Components of beam direction vectors"; CPython3
# ---------- components_of_beam_direction.python (27 lines) ----------
# Carga las bibliotecas de DesignScript y normas de Python.
import sys
import clr
clr.AddReference('ProtoGeometry')
from Autodesk.DesignScript.Geometry import *

# Las entradas de este nodo se almacenan como lista en las variables IN.
dataEnteringNode = IN


# Las entradas de este nodo se almacenan como lista en las variables IN.
dataEnteringNode = IN
locVecx=IN[0]
locVecy=IN[1]
locVecz=IN[2]

locVx=[]
locVy=[]
locVz=[]
nb=len(locVecx)
for i in range(0,nb):
    locVx.append(round(locVecx[i],2))
    locVy.append(round(locVecy[i],2))
    locVz.append(round(locVecz[i],2))

# Asigne la salida a la variable OUT.
OUT = [locVx,locVy,locVz]
# ----------------------------------------
separation_of_links_in_spans = CodeBlock(dimShearbar=importCSV, initiBeams=initial_point_locations_of_beam, direcBeams=components_of_beam_direction) { dimShearbar; initiBeams; direcBeams; }
file_path_2 = Filename("Design_Data\RebarBeams\dimBeamsCollec.csv")
boolean_2 = BoolSelector(true)
importCSV_2 = Data.ImportCSV(filePath=file_path_2, transpose=boolean_2)
dimensions_of_beams = CodeBlock(beamDim=importCSV_2) { beamDim; }
distribution_stirrrup_ties = Python(IN[0]=separation_of_links_in_spans.dimShearbar, IN[1]=dimensions_of_beams)  # CPython3
# ---------- distribution_stirrrup_ties.python (57 lines) ----------
# Carga las bibliotecas de DesignScript y normas de Python.
import sys
import clr
clr.AddReference('ProtoGeometry')
from Autodesk.DesignScript.Geometry import *

# Las entradas de este nodo se almacenan como lista en las variables IN.
dataEnteringNode = IN

dimShear=IN[0]
dimBeam=IN[1]

nbeams=len(dimBeam)

# Incluya el código debajo de esta línea
z_global=[]
n1=[]
n2=[]
n3=[]
for j in range(0,nbeams):
    a=dimBeam[j][3] # horizontal concrete cover
    d1=dimShear[j][2]
    d2=dimShear[j][3]
    lenBeam=dimBeam[j][2]
    
    # Left part of beam
    sep1=dimShear[j][0]
    
    n1.append(int((d1-2*a)/sep1)+1)
    ze=a
    z1=[]
    for i in range(0,n1[j]):
        z1.append(ze)
        ze=ze+sep1
    
    # Mid part of beam
    sep2=dimShear[j][1]
    d=lenBeam-d1-d2
    n2.append(int((d-2*a)/sep2)+1)
    
    for i in range(0,n2[j]):
        z1.append(ze)
        ze=ze+sep2
    
    # Right part of beam
    sep3=dimShear[j][2]
    n3.append(int((d2-2*a)/sep3)+1)
    
    ze=ze-sep2+sep3
    for i in range(0,n3[j]):
        z1.append(ze)
        ze=ze+sep3
    
    z_global.append(z1)
	
# Asigne la salida a la variable OUT.
OUT = z_global
# ----------------------------------------
curve_stirrup_links = Python(IN[0]=separation_of_links_in_spans.dimShearbar, IN[1]=separation_of_links_in_spans.initiBeams, IN[2]=separation_of_links_in_spans.direcBeams, IN[3]=dimensions_of_beams)  # CPython3
# ---------- curve_stirrup_links.python (65 lines) ----------
# Carga las bibliotecas de DesignScript y normas de Python.
import sys
import clr
clr.AddReference('ProtoGeometry')
from Autodesk.DesignScript.Geometry import *

# Las entradas de este nodo se almacenan como lista en las variables IN.
dataEnteringNode = IN

shearbeams=IN[0]
initBeam=IN[1]
dirBeam=IN[2]
dimbeams=IN[3]

lb=len(dimbeams)
# Incluya el código debajo de esta línea
pol_curv=[]

for i in range(0,lb):
    b=dimbeams[i][0]
    h=dimbeams[i][1]
    
    brec=dimbeams[i][3]
    hrec=dimbeams[i][4]
    
    dvsi=shearbeams[i][5]
    xbi=initBeam[0][i]
    ybi=initBeam[1][i]
    zbi=initBeam[2][i]
    
    dxb=dirBeam[0][i]
    dyb=dirBeam[1][i]
    dzb=dirBeam[2][i]
    
    xncornerLink=0.5*b-brec-0.5*dvsi
    yncornerLink=0.5*h-hrec-0.5*dvsi
    
    yc1=-dyb
    xc1=dxb
    
    yc2=dyb
    xc2=-dxb
    
    zc1=-dxb
    
    pcb1=Point.ByCoordinates(xbi+xncornerLink*yc1,ybi+xncornerLink*xc1,zbi+yncornerLink*xc1+yncornerLink*yc1)
    
    pcb2=Point.ByCoordinates(xbi+xncornerLink*yc2,ybi+xncornerLink*xc2,zbi+yncornerLink*xc1+yncornerLink*yc1)
    
    pcb3=Point.ByCoordinates(xbi+xncornerLink*yc2,ybi+xncornerLink*xc2,zbi-yncornerLink*xc1-yncornerLink*yc1)
    
    pcb4=Point.ByCoordinates(xbi+xncornerLink*yc1,ybi+xncornerLink*xc1,zbi-yncornerLink*xc1-yncornerLink*yc1)
        
    curve1=Line.ByStartPointEndPoint(pcb1,pcb2)
    curve2=Line.ByStartPointEndPoint(pcb2,pcb3)
    curve3=Line.ByStartPointEndPoint(pcb3,pcb4)
    curve4=Line.ByStartPointEndPoint(pcb4,pcb1)
    
    curve_link=[curve1,curve2,curve3,curve4]

    pc=PolyCurve.ByJoinedCurves(curve_link)
    pol_curv.append(pc)
 
# Asigne la salida a la variable OUT.
OUT = pol_curv
# ----------------------------------------
all_links_per_beam = Python(IN[0]=distribution_stirrrup_ties, IN[1]=separation_of_links_in_spans.direcBeams, IN[2]=curve_stirrup_links)  # CPython3
# ---------- all_links_per_beam.python (31 lines) ----------
# Carga las bibliotecas de DesignScript y normas de Python.
import sys
import clr
clr.AddReference('ProtoGeometry')
from Autodesk.DesignScript.Geometry import *

# Las entradas de este nodo se almacenan como lista en las variables IN.
dataEnteringNode = IN

copiesLinksBeams=IN[0]
direcBeams=IN[1]
listLinks=IN[2]

# Incluya el código debajo de esta línea
nbeams=len(listLinks)

linksBeam=[]
for i in range(0,nbeams):
    dbx=direcBeams[0][i]
    dby=direcBeams[1][i]
    dbz=direcBeams[2][i]
    
    copLink=[]
    nlinks=len(copiesLinksBeams[i])
    for j in range(0,nlinks):
        copiedLinked=Geometry.Translate(listLinks[i],copiesLinksBeams[i][j]*dbx,copiesLinksBeams[i][j]*dby,copiesLinksBeams[i][j]*dbz)
        copLink.append(copiedLinked)
    linksBeam.append(copLink)
        
# Asigne la salida a la variable OUT.
OUT = linksBeam
# ----------------------------------------
explode = Geometry.Explode(geometry=all_links_per_beam)
rebarStyle = RevitRebarStyle("StirrupTie")
diameter_of_shear_links = Python(IN[0]=importCSV)  # CPython3
# ---------- diameter_of_shear_links.python (19 lines) ----------
# Carga las bibliotecas de DesignScript y normas de Python.
import sys
import clr
clr.AddReference('ProtoGeometry')
from Autodesk.DesignScript.Geometry import *

# Las entradas de este nodo se almacenan como lista en las variables IN.
dataEnteringNode = IN

shearBeams=IN[0]
nbeams=len(shearBeams)
StrdiamRebarLink=[]
for i in range(0,nbeams):
    dlinks=int(shearBeams[0][5])
    strconcdiami="H"+str(dlinks)
    StrdiamRebarLink.append(strconcdiami)
    
# Asigne la salida a la variable OUT.
OUT = StrdiamRebarLink
# ----------------------------------------
rebarBarTypefromName = Custom[RebarBarTypefromName](listofrebarbartypes=diameter_of_shear_links)  # package PracticalBIM; Gets the Rebar Bar Types from a List with names
rebarHookType = RevitRebarHookType("Stirrup/Tie - 135 deg.")
rebarHookOrientation = RevitRebarHookOrientation("Left")
list_of_elements = Python(IN[0]=select_model_elements)  # CPython3
# ---------- list_of_elements.python (19 lines) ----------
# Carga las bibliotecas de DesignScript y normas de Python.
import sys
import clr
clr.AddReference('ProtoGeometry')
from Autodesk.DesignScript.Geometry import *

# Las entradas de este nodo se almacenan como lista en las variables IN.
dataEnteringNode = IN

# Incluya el código debajo de esta línea
b_elems= IN[0]
nd=len(b_elems)

beams=[]
for i in range(0,nd):
	beam=b_elems[i]
	beams.append(beam)
# Asigne la salida a la variable OUT.
OUT = beams
# ----------------------------------------
all_links = Python(IN[0]=all_links_per_beam)  # CPython3
# ---------- all_links.python (23 lines) ----------
# Carga las bibliotecas de DesignScript y normas de Python.
import sys
import clr
clr.AddReference('ProtoGeometry')
from Autodesk.DesignScript.Geometry import *

# Las entradas de este nodo se almacenan como lista en las variables IN.
dataEnteringNode = IN

list_curves=IN[0]

nc=len(list_curves)
# Incluya el código debajo de esta línea

list_last_curves=[]
for i in range(0,nc):
	curves=[]
	ne=len(list_curves[i])
	curves.append(list_curves[i][ne-1])
	list_last_curves.append(list_curves[i][ne-1])
# Asigne la salida a la variable OUT.

OUT = list_last_curves
# ----------------------------------------
normal = Curve.Normal(curve=all_links)
fromCurves = StructuralDesign.Rebar.Create.FromCurves(curves=explode, rebarStyle=rebarStyle, rebarBarType=rebarBarTypefromName, startHookType=rebarHookType, endHookType=rebarHookType, startHookOrientation=rebarHookOrientation, endHookOrientation=rebarHookOrientation, hostElement=list_of_elements, vector=normal)
file_path_3 = Filename("Design_Data\RebarBeams\DistrBarBeams3sec.csv")
boolean_3 = BoolSelector(true)
importCSV_3 = Data.ImportCSV(filePath=file_path_3, transpose=boolean_3)
file_path_4 = Filename("Design_Data\RebarBeams\nBarBeamsCollec.csv")
boolean_4 = BoolSelector(true)
importCSV_4 = Data.ImportCSV(filePath=file_path_4, transpose=boolean_4)
file_path_5 = Filename("Design_Data\RebarBeams\NbarsTot3sec.csv")
boolean_5 = BoolSelector(true)
importCSV_5 = Data.ImportCSV(filePath=file_path_5, transpose=boolean_5)
file_path_6 = Filename("Design_Data\RebarBeams\LenBarBeams3sec.csv")
boolean_6 = BoolSelector(true)
importCSV_6 = Data.ImportCSV(filePath=file_path_6, transpose=boolean_6)
file_path_7 = Filename("Design_Data\RebarBeams\DistrSb.csv")
boolean_7 = BoolSelector(true)
importCSV_7 = Data.ImportCSV(filePath=file_path_7, transpose=boolean_7)
file_path_8 = Filename("Design_Data\RebarBeams\NSb.csv")
boolean_8 = BoolSelector(true)
importCSV_8 = Data.ImportCSV(filePath=file_path_8, transpose=boolean_8)
file_path_9 = Filename("Design_Data\RebarBeams\TendbBeams.csv")
boolean_9 = BoolSelector(true)
importCSV_9 = Data.ImportCSV(filePath=file_path_9, transpose=boolean_9)
total_depth_of_tension_bars = Python(IN[0]=importCSV_9, IN[1]=importCSV_2, IN[2]=importCSV_4)  # CPython3
# ---------- total_depth_of_tension_bars.python (45 lines) ----------
# Carga las bibliotecas de DesignScript y normas de Python.
import sys
import clr
clr.AddReference('ProtoGeometry')
from Autodesk.DesignScript.Geometry import *
import math as m

# Las entradas de este nodo se almacenan como lista en las variables IN.
dataEnteringNode = IN
db18=IN[0]
dimbeam=IN[1]
nb18=IN[2]

# Incluya el código debajo de esta línea

nb=len(db18)
debeam=[]
nlayBeam=[]
for i in range(0,nb):
    ccbeam=dimbeam[i][4]
    # Number of layers for each cross-section
    nbCum=0
    deSec=[]
    nlaySec=[]
    for z in range(0,3): # loop over sections
        
        de=ccbeam+10
        nlay=0
        for j in range(0,3): # loop over layers
            if nb18[i][nbCum+j*2-1+1]+nb18[i][nbCum+j*2+1]>0:
                nlay=nlay+1
            dbe=db18[i][nbCum+j*2-1+1]
            dbm=db18[i][nbCum+j*2+1]
            dbmaxLay=max([dbe,dbm])
            vsepLay=max([dbmaxLay,25])
            de=de+dbmaxLay+vsepLay
        deSec.append(de)
        nlaySec.append(nlay)
        nbCum=nbCum+6
    debeam.append(deSec)
    nlayBeam.append(nlaySec)
    
# Asigne la salida a la variable OUT.

OUT = debeam
# ----------------------------------------
longitudinal_rebar = Python(IN[0]=importCSV, IN[1]=importCSV_2, IN[2]=initial_point_locations_of_beam, IN[3]=importCSV_3, IN[4]=importCSV_4, IN[5]=components_of_beam_direction, IN[6]=importCSV_5, IN[7]=importCSV_6, IN[8]=importCSV_7, IN[9]=importCSV_8, IN[10]=total_depth_of_tension_bars)  # CPython3
# ---------- longitudinal_rebar.python (270 lines) ----------
# Carga las bibliotecas de DesignScript y normas de Python.
import sys
import clr
clr.AddReference('ProtoGeometry')
from Autodesk.DesignScript.Geometry import *
import math as m

# Las entradas de este nodo se almacenan como lista en las variables IN.
dataEnteringNode = IN

dvsBeam=IN[0]
DimBeams=IN[1]
originBeams=IN[2]
distrRebar3Sec=IN[3]
NbarsTen=IN[4]
direcBeams=IN[5]
NbarTotBeam=IN[6]
LenBars=IN[7]
distrBarBeamsSb=IN[8]
nsb=IN[9]
deBeam=IN[10]

# Distribution of rebar - Left section
d=400
anchorLenBentBars=[]
axRebarLeft=[]
axRebarMid=[]
axRebarRight=[]
axRebarSb=[]

nbeams=len(NbarsTen)
nbarsCumL=0
nbarsCumM=0
nbarsCumR=0

nbarsCumSb=0

nbarTotLAllbeams=0
nbarTotMAllbeams=0
nbarTotRAllbeams=0
angxyzBeam=[]
nbarTenAllL=0
nbarTenAllM=0
nbarTenAllR=0
dirVecBeams1=[]
dirVecBeams2=[]
radxyzBeam=[]
for i in range(0,nbeams):
    nbarTotLAllbeams=nbarTotLAllbeams+NbarTotBeam[i][0]
    nbarTotMAllbeams=nbarTotMAllbeams+NbarTotBeam[i][1]
    nbarTotRAllbeams=nbarTotRAllbeams+NbarTotBeam[i][2]
    
    nbarTenAllL=nbarTenAllL+NbarsTen[i][0]+NbarsTen[i][1]+NbarsTen[i][2]+NbarsTen[i][3]+NbarsTen[i][4]+NbarsTen[i][5]
    
    nbarTenAllM=nbarTenAllM+NbarsTen[i][6]+NbarsTen[i][7]+NbarsTen[i][8]+NbarsTen[i][9]+NbarsTen[i][10]+NbarsTen[i][11]
    
    direcBix=direcBeams[0][i]
    direcBiy=direcBeams[1][i]
    direcBiz=direcBeams[2][i]
    
    angxi=m.acos(direcBix)
    angyi=m.acos(direcBiy)
    angzi=m.acos(direcBiz)
    radxyzBeam.append([angxi,angyi,angzi])
    angxyzBeam.append([m.degrees(angxi),m.degrees(angyi),m.degrees(angzi)])
    
    direcBeamVec1=Vector.ByCoordinates(direcBix,direcBiy,direcBiz)
    direcBeamVec2=Vector.ByCoordinates(-direcBix,-direcBiy,-direcBiz)
    
    dirVecBeams1.append(direcBeamVec1)
    dirVecBeams2.append(direcBeamVec2)
    
nbarsCumTenL=0
nbarsCumTenM=0
nbarsCumTenR=0
for i in range(0,nbeams):
    
    xbi=originBeams[0][i]
    ybi=originBeams[1][i]
    zbi=originBeams[2][i]
    
    direcBix=direcBeams[0][i]
    direcBiy=direcBeams[1][i]
    direcBiz=direcBeams[2][i]
    
    spanBeami=DimBeams[i][2]
    h=DimBeams[i][1]
    hcover=DimBeams[i][3]
    bcover=DimBeams[i][2]
    
    # Left section
    nbartL=NbarsTen[i][0]+NbarsTen[i][1]+NbarsTen[i][2]+NbarsTen[i][3]+NbarsTen[i][4]+NbarsTen[i][5]
    for j  in range(0,nbartL):
        xrebari=distrRebar3Sec[nbarsCumL+j][0]
        yrebari=distrRebar3Sec[nbarsCumL+j][1]
        
        xc=-direcBix
        yc=direcBiy
        zc=direcBiz
        
        lbariL=LenBars[nbarsCumTenL+j][0]
        if i+1==2:
            if lbariL==spanBeami:
                lanchor=(h-deBeam[i][2]-deBeam[i+1][0])/m.cos(3.1416/2-radxyzBeam[i][2]-radxyzBeam[i-1][2])
        elif i+1==3:
            extraL=(h-deBeam[i-1][2]-deBeam[i][0])/m.cos(3.1416/2-radxyzBeam[i][2]-radxyzBeam[i-1][2])
            lanchor=0
        else:
            extraL=0
            lanchor=0
        xloc=xbi+xrebari*yc+extraL*direcBix
        yloc=ybi+xrebari*xc+extraL*direcBiy
        zloc=zbi+yrebari
                
        p1b=Point.ByCoordinates(xloc,yloc,zloc)
            
        axisRebari=Line.ByStartPointDirectionLength(p1b,dirVecBeams1[i],lbariL+abs(extraL)+abs(lanchor))
        axRebarLeft.append(axisRebari)
    
        # Bent bar lengths
        if i+1==2:
            xloc=xbi+xrebari*yc+(spanBeami+abs(lanchor))*direcBix
            yloc=ybi+xrebari*xc+(spanBeami+abs(lanchor))*direcBiy
            zloc=zbi+yrebari+(spanBeami+abs(lanchor))*zc
            
            p1b=Point.ByCoordinates(xloc,yloc,zloc)
            axisRebari=Line.ByStartPointDirectionLength(p1b,dirVecBeams1[i+1],d)
            anchorLenBentBars.append(axisRebari)
        elif i+1==3:
                
            p1b=Point.ByCoordinates(xloc,yloc,zloc)
            axisRebari=Line.ByStartPointDirectionLength(p1b,dirVecBeams2[i-1],d)
            anchorLenBentBars.append(axisRebari)
                
    # Mid section
    nbartM=NbarsTen[i][6]+NbarsTen[i][7]+NbarsTen[i][8]+NbarsTen[i][9]+NbarsTen[i][10]+NbarsTen[i][11]
    
    for j  in range(0,nbartM):
        xrebari=distrRebar3Sec[nbarTotLAllbeams+nbarsCumM+j][0]
        yrebari=distrRebar3Sec[nbarTotLAllbeams+nbarsCumM+j][1]
        
        lbariM=LenBars[nbarTenAllL+nbarsCumTenM+j][0]
        
        xc=-direcBix
        yc=direcBiy
        zc=direcBiz
        
        xloc=xbi+(0.5*spanBeami-0.5*lbariM)*direcBix+xrebari*yc
        yloc=ybi+(0.5*spanBeami-0.5*lbariM)*direcBiy+xrebari*xc
        zloc=zbi+yrebari+(0.5*spanBeami-0.5*lbariM)*zc
        if i+1==1:
            if lbariM==spanBeami:
                if direcBeams[2][i+1]<0: # if the stairs are going down
                    extraL=-(h-deBeam[i+1][0]-deBeam[i][2])/m.cos(3.1416/2-radxyzBeam[i][2]-radxyzBeam[i+1][2])
                    #extraL=-(h-deBeam[i][2]-deBeam[i+1][0])/m.tan(radxyzBeam[i+1][2])
                else:
                    extraL=-h*m.tan(angxyzBeam[i][2])+deBeam[i+1][0]*m.cos(3.1416-radxyzBeam[i+1][2])
                    
                lanchor=lbariM+extraL
            else:
                lanchor=lbariM
        elif i+1==2:
            if lbariM==spanBeami:
                extraL=-(h-deBeam[i-1][2]-deBeam[i][0])/m.cos(3.1416/2-radxyzBeam[i][2]-radxyzBeam[i-1][2])
                
                xloc=xbi+(0.5*spanBeami-0.5*lbariM-extraL)*direcBix+xrebari*yc
                yloc=ybi+(0.5*spanBeami-0.5*lbariM-extraL)*direcBiy+xrebari*xc
                zloc=zbi+yrebari+(0.5*spanBeami-0.5*lbariM-extraL)*zc
                
                lanchor=lbariM+extraL
            else:
                lanchor=lbariM
        elif i+1==3:
            if lbariM==spanBeami:
                xloc=xbi+(0.5*spanBeami-0.5*lbariM)*direcBix+xrebari*yc
                yloc=ybi+(0.5*spanBeami-0.5*lbariM)*direcBiy+xrebari*xc
                zloc=zbi+yrebari+(0.5*spanBeami-0.5*lbariM)*zc
                
                lanchor=lbariM
            else:
                lanchor=lbariM
        p1b=Point.ByCoordinates(xloc,yloc,zloc)
        
        axisRebari=Line.ByStartPointDirectionLength(p1b,dirVecBeams1[i],lanchor)
        axRebarMid.append(axisRebari)
        
        # Bent bar lengths
        
        if i+1==1:
            if lbariM==spanBeami:
                xloc=xbi+(0.5*spanBeami-0.5*lbariM+lanchor)*direcBix+xrebari*yc
                yloc=ybi+(0.5*spanBeami-0.5*lbariM+lanchor)*direcBiy+xrebari*xc
                zloc=zbi+yrebari+(0.5*spanBeami-0.5*lbariM+lanchor)*zc
                
                p1b=Point.ByCoordinates(xloc,yloc,zloc)
                axisRebari=Line.ByStartPointDirectionLength(p1b,dirVecBeams1[i+1],d)
                anchorLenBentBars.append(axisRebari)
        elif i+1==2:
            if lbariM==spanBeami:
                xloc=xbi+(0.5*spanBeami-0.5*lbariM-extraL)*direcBix+xrebari*yc
                yloc=ybi+(0.5*spanBeami-0.5*lbariM-extraL)*direcBiy+xrebari*xc
                zloc=zbi+yrebari+(0.5*spanBeami-0.5*lbariM-extraL)*zc
                p1b=Point.ByCoordinates(xloc,yloc,zloc)
                axisRebari=Line.ByStartPointDirectionLength(p1b,dirVecBeams2[i-1],d)
                anchorLenBentBars.append(axisRebari)
                
    # Right section
    
    nbartR=NbarsTen[i][12]+NbarsTen[i][13]+NbarsTen[i][14]+NbarsTen[i][15]+NbarsTen[i][16]+NbarsTen[i][17]
    for j  in range(0,nbartR):
        xrebari=distrRebar3Sec[nbarTotLAllbeams+nbarTotMAllbeams+nbarsCumR+j][0]
        yrebari=distrRebar3Sec[nbarTotLAllbeams+nbarTotMAllbeams+nbarsCumR+j][1]
        
        xc=-direcBix
        yc=direcBiy
        zc=direcBiz
        
        if i+1==2:
            
            extraL=-(h-deBeam[i-1][2]-deBeam[i][0])/m.cos(3.1416/2-radxyzBeam[i][2]-radxyzBeam[i-1][2])
        else:
            extraL=0
        xloc=xbi+(spanBeami-extraL)*direcBix+xrebari*yc
        yloc=ybi+(spanBeami-extraL)*direcBiy+xrebari*xc
        zloc=zbi+yrebari+(spanBeami-extraL)*zc
        
        p1b=Point.ByCoordinates(xloc,yloc,zloc)
        
        lbariR=LenBars[nbarTenAllL+nbarTenAllM+nbarsCumTenR+j][0]
        
        if lbariR!=0:
            axisRebari=Line.ByStartPointDirectionLength(p1b,dirVecBeams2[i],lbariR+abs(extraL))
            
            axRebarRight.append(axisRebari)
            
        # Bent bar lengths
        
        if i+1==2:
            if lbariR!=0:
                
                p1b=Point.ByCoordinates(xloc,yloc,zloc)
                axisRebari=Line.ByStartPointDirectionLength(p1b,dirVecBeams1[i+1],d)
                anchorLenBentBars.append(axisRebari)
                
    # Side rebars
    nsbb=int(nsb[i][0])
    for j  in range(0,nsbb):
        xrebari=distrBarBeamsSb[nbarsCumSb+j][0]
        yrebari=distrBarBeamsSb[nbarsCumSb+j][1]
        
        xc=-direcBix
        yc=direcBiy
        
        p1b=Point.ByCoordinates(xbi+xrebari*yc,ybi+xrebari*xc,zbi+yrebari)
        
        axisRebari=Line.ByStartPointDirectionLength(p1b,dirVecBeams1[i],spanBeami)
        axRebarSb.append(axisRebari)
        
    nbarsCumSb=nbarsCumSb+nsb[i][0]
    
    nbarsCumL=nbarsCumL+NbarTotBeam[i][0]
    nbarsCumM=nbarsCumM+NbarTotBeam[i][1]
    nbarsCumR=nbarsCumR+NbarTotBeam[i][2]
    
    nbarsCumTenL=nbarsCumTenL+nbartL
    nbarsCumTenM=nbarsCumTenM+nbartM
    nbarsCumTenR=nbarsCumTenR+nbartR
    
# Asigne la salida a la variable OUT.
OUT = [axRebarLeft,axRebarMid,axRebarRight,axRebarSb,anchorLenBentBars]
# ----------------------------------------
file_path_10 = Filename("Design_Data\RebarBeams\DiamBarBeamsCollec3sec.csv")
boolean_10 = BoolSelector(true)
importCSV_10 = Data.ImportCSV(filePath=file_path_10, transpose=boolean_10)
file_path_11 = Filename("Design_Data\RebarBeams\DiamListSb.csv")
boolean_11 = BoolSelector(true)
importCSV_11 = Data.ImportCSV(filePath=file_path_11, transpose=boolean_11)
list_of_rebar_diameters = Python(IN[0]=importCSV_4, IN[1]=importCSV_5, IN[2]=importCSV_6, IN[3]=importCSV_10, IN[4]=importCSV_8, IN[5]=importCSV_11)  # CPython3
# ---------- list_of_rebar_diameters.python (106 lines) ----------
# Carga las bibliotecas de DesignScript y normas de Python.
import sys
import clr
clr.AddReference('ProtoGeometry')
from Autodesk.DesignScript.Geometry import *

# Las entradas de este nodo se almacenan como lista en las variables IN.
dataEnteringNode = IN

NbarsTen=IN[0]
NbarTotBeam=IN[1]
LenBars=IN[2]
diamBar=IN[3]
nsb=IN[4]
dsb=IN[5]

nbarsCum=0
nbarsCumSb=0

nbeams=len(NbarTotBeam)
nbarTotLAllbeams=0
nbarTotMAllbeams=0
nbarTotRAllbeams=0
nbarTenAllL=0
nbarTenAllM=0
nbarTenAllR=0
for i in range(0,nbeams):
    nbarTotLAllbeams=nbarTotLAllbeams+NbarTotBeam[i][0]
    nbarTotMAllbeams=nbarTotMAllbeams+NbarTotBeam[i][1]
    nbarTotRAllbeams=nbarTotRAllbeams+NbarTotBeam[i][2]
    
    nbarTenAllL=nbarTenAllL+NbarsTen[i][0]+NbarsTen[i][1]+NbarsTen[i][2]+NbarsTen[i][3]+NbarsTen[i][4]+NbarsTen[i][5]
    
    nbarTenAllM=nbarTenAllM+NbarsTen[i][6]+NbarsTen[i][7]+NbarsTen[i][8]+NbarsTen[i][9]+NbarsTen[i][10]+NbarsTen[i][11]
    
diamRebarTenLeft=[]
diamRebarTenMid=[]
diamRebarTenRight=[]

StrdiamRebarTenLeft=[]
StrdiamRebarTenMid=[]
StrdiamRebarTenRight=[]

diamRebarSb=[]
StrdiamRebarSb=[]
nbarsCumL=0
nbarsCumM=0
nbarsCumR=0
nbarsCumTenL=0
nbarsCumTenM=0
nbarsCumTenR=0
for i in range(0,nbeams):
    
    # Left section
    nbartL=NbarsTen[i][0]+NbarsTen[i][1]+NbarsTen[i][2]+NbarsTen[i][3]+NbarsTen[i][4]+NbarsTen[i][5]
    
    for j  in range(0,nbartL):
        drebari=diamBar[nbarsCumL+j][0]
        
        diamRebarTenLeft.append(drebari)
        strconcdiami="H"+str(drebari)
        StrdiamRebarTenLeft.append(strconcdiami)
        
    # Mid section
    nbartM=NbarsTen[i][6]+NbarsTen[i][7]+NbarsTen[i][8]+NbarsTen[i][9]+NbarsTen[i][10]+NbarsTen[i][11]
    
    for j  in range(0,nbartM):
        
        drebari=diamBar[nbarTotLAllbeams+nbarsCumM+j][0]
        diamRebarTenMid.append(drebari)
        strconcdiami="H"+str(drebari)
        StrdiamRebarTenMid.append(strconcdiami)
        
    # Right section
    nbartR=NbarsTen[i][12]+NbarsTen[i][13]+NbarsTen[i][14]+NbarsTen[i][15]+NbarsTen[i][16]+NbarsTen[i][17]
    
    for j  in range(0,nbartR):
        drebari=diamBar[nbarTotLAllbeams+nbarTotMAllbeams+nbarsCumR+j][0]
        diamRebarTenRight.append(drebari)
        
        lbariR=LenBars[nbarTenAllL+nbarTenAllM+nbarsCumTenR+j][0]
        
        if lbariR!=0:
            strconcdiami="H"+str(drebari)
            StrdiamRebarTenRight.append(strconcdiami)
            
    
    # Side rebars
    nsbb=int(nsb[i][0])
    for j  in range(0,nsbb):
        drebari=dsb[nbarsCumSb+j][0]
        diamRebarSb.append(drebari)
        strconcdiami="H"+str(drebari)
        StrdiamRebarSb.append(strconcdiami)
        
    nbarsCumSb=nbarsCumSb+nsb[i][0]
    nbarsCumTenL=nbarsCumTenL+nbartL
    nbarsCumTenM=nbarsCumTenM+nbartM
    nbarsCumTenR=nbarsCumTenR+nbartR
    
    nbarsCumL=nbarsCumL+NbarTotBeam[i][0]
    nbarsCumM=nbarsCumM+NbarTotBeam[i][1]
    nbarsCumR=nbarsCumR+NbarTotBeam[i][2]
    
# Asigne la salida a la variable OUT.
OUT = [StrdiamRebarTenLeft,StrdiamRebarTenMid,StrdiamRebarTenRight,StrdiamRebarSb]
# ----------------------------------------
rebar_list_left_mid_right = CodeBlock(rebarDiam=list_of_rebar_diameters) { rebarDiam[0]; rebarDiam[1]; rebarDiam[2]; rebarDiam[3]; }
rebarBarTypefromName_2 = Custom[RebarBarTypefromName](listofrebarbartypes=rebar_list_left_mid_right.out0)
rebarBarTypefromName_3 = Custom[RebarBarTypefromName](listofrebarbartypes=rebar_list_left_mid_right.out1)
rebarBarTypefromName_4 = Custom[RebarBarTypefromName](listofrebarbartypes=rebar_list_left_mid_right.out2)
rebarBarTypefromName_5 = Custom[RebarBarTypefromName](listofrebarbartypes=rebar_list_left_mid_right.out3)
rebar = Python(IN[0]=list_of_elements, IN[1]=longitudinal_rebar, IN[2]=importCSV_2, IN[3]=importCSV_4, IN[4]=importCSV_8, IN[5]=importCSV_6, IN[6]=rebarBarTypefromName_2, IN[7]=rebarBarTypefromName_3, IN[8]=rebarBarTypefromName_4, IN[9]=rebarBarTypefromName_5)  # CPython3
# ---------- rebar.python (136 lines) ----------
# Carga las bibliotecas de DesignScript y normas de Python.
import sys
import clr
clr.AddReference('ProtoGeometry')
from Autodesk.DesignScript.Geometry import *

import StructuralDesign as strcdes
# Las entradas de este nodo se almacenan como lista en las variables IN.
dataEnteringNode = IN

hostElm=IN[0]
rebarAx=IN[1]
dimBeams=IN[2]
nbTSecBeams=IN[3]
nsb=IN[4]
lenbars=IN[5]
rebarTypesL=IN[6]
rebarTypesM=IN[7]
rebarTypesR=IN[8]
rebarTypesSb=IN[9]

# Initialization of function
rebarAxL=rebarAx[0]
rebarAxM=rebarAx[1]
rebarAxR=rebarAx[2]
rebarAxBents=rebarAx[4]

nrebarCumL=0
nrebarCumM=0
nrebarCumR=0
nrebarCumSb=0

nbarTotTenAllbeamsL=0
nbarTotTenAllbeamsM=0
nbeams=len(hostElm)
for i in range(0,nbeams):
    nbarTotTenAllbeamsL=nbarTotTenAllbeamsL+nbTSecBeams[i][0]+nbTSecBeams[i][1]+nbTSecBeams[i][2]+nbTSecBeams[i][3]+nbTSecBeams[i][4]+nbTSecBeams[i][5]
    
    nbarTotTenAllbeamsM=nbarTotTenAllbeamsM+nbTSecBeams[i][6]+nbTSecBeams[i][7]+nbTSecBeams[i][8]+nbTSecBeams[i][9]+nbTSecBeams[i][10]+nbTSecBeams[i][11]
    
rebarbentindx=[]
rebarLeft=[]
rebarMid=[]
rebarRight=[]
rebarSb=[]
rebarBent=[]
nrebarRCumLenDif0=0
nrebarBent=0
for i in range(0,nbeams):
    lenBeam=dimBeams[i][2]
    beamElm=hostElm[i]
    # Left section
    nrebarsbeamL=nbTSecBeams[i][0]+nbTSecBeams[i][1]+nbTSecBeams[i][2]+nbTSecBeams[i][3]+nbTSecBeams[i][4]+nbTSecBeams[i][5]
    
    rebarbeam=[]
    rebarbeamBent=[]
    jj=0
    for j in range(0,nrebarsbeamL):
        rebari=strcdes.Rebar.Create.FreeFormRebar(rebarTypesL[nrebarCumL+j],beamElm,[[rebarAxL[nrebarCumL+j]]])
        
        rebarbeam.append(rebari)
         
        if i+1==2 or i+1==3:
            rebari=strcdes.Rebar.Create.FreeFormRebar(rebarTypesL[nrebarCumL+j],beamElm,[[rebarAxBents[nrebarBent+jj]]])
            
            rebarbeamBent.append(rebari)
            jj=jj+1
    nrebarBent=nrebarBent+jj
    rebarBent.append(rebarbeamBent)
    
    rebarLeft.append(rebarbeam)
    nrebarCumL=nrebarCumL+nrebarsbeamL
    
    # Mid section
    nrebarsbeamM=nbTSecBeams[i][6]+nbTSecBeams[i][7]+nbTSecBeams[i][8]+nbTSecBeams[i][9]+nbTSecBeams[i][10]+nbTSecBeams[i][11]
    
    rebarbeam=[]
    rebarbeamBent=[]
    jj=0
    for j in range(0,nrebarsbeamM):
        rebari=strcdes.Rebar.Create.FreeFormRebar(rebarTypesM[nrebarCumM+j],beamElm,[[rebarAxM[nrebarCumM+j]]])
        
        rebarbeam.append(rebari)
        
        lenbar=lenbars[nbarTotTenAllbeamsL+nrebarCumM+j][0]
        if lenbar==lenBeam: 
            if i+1==1 or i+1==2:
                rebari=strcdes.Rebar.Create.FreeFormRebar(rebarTypesM[nrebarCumM+j],beamElm,[[rebarAxBents[nrebarBent+jj]]])
                
                rebarbeamBent.append(rebari)
                jj=jj+1
    nrebarBent=nrebarBent+jj
    
    rebarMid.append(rebarbeam)
    rebarBent.append(rebarbeamBent)
    
    
    nrebarCumM=nrebarCumM+nrebarsbeamM
    
    # Right section
    nrebarsbeamR=nbTSecBeams[i][12]+nbTSecBeams[i][13]+nbTSecBeams[i][14]+nbTSecBeams[i][15]+nbTSecBeams[i][16]+nbTSecBeams[i][17]
    rebarbeam=[]
    jj=0
    for j in range(0,nrebarsbeamR):
        lenbar=lenbars[nbarTotTenAllbeamsL+nbarTotTenAllbeamsM+nrebarCumR+j][0]
        if lenbar>0:
            rebari=strcdes.Rebar.Create.FreeFormRebar(rebarTypesR[nrebarRCumLenDif0+jj],beamElm,[[rebarAxR[nrebarRCumLenDif0+jj]]])
            
            rebarbeam.append(rebari)
            
            jj=jj+1
            
    
    nrebarRCumLenDif0=nrebarRCumLenDif0+jj
    rebarRight.append(rebarbeam)
    nrebarCumR=nrebarCumR+nrebarsbeamR
    
    # Side rebars
    rebarAxSb=rebarAx[3]
    lr=len(rebarAxSb)
    nrebarsbeamSb=nsb[i][0]
    if lr>0:
        rebarbeam=[]
        for j in range(0,nrebarsbeamSb):
            rebari=strcdes.Rebar.Create.FreeFormRebar(rebarTypesSb[nrebarCumSb+j],beamElm,[[rebarAxSb[nrebarCumSb+j]]])
            
            rebarbeam.append(rebari)
        
        rebarSb.append(rebarbeam)
        
    nrebarCumSb=nrebarCumSb+nrebarsbeamSb
    
# Incluya el código debajo de esta línea

# Asigne la salida a la variable OUT.
OUT = [rebarLeft,rebarMid,rebarRight,rebarSb,rebarBent]
# ----------------------------------------
length = Curve.Length(curve=getLocation)
