# Dynamo graph Multistory_Column.dyn (Dynamo 2.19.3.6394)
# packages: Structural Design 2023.4.25, Structural Design 2024.4.15, PracticalBIM 2020.0.43

file_path = Filename("Design_Data\RebarMSColumns\ShearColsDesign.csv")
boolean = BoolSelector(true)
importCSV = Data.ImportCSV(filePath=file_path, transpose=boolean)
select_model_elements = DSModelElementsSelection()  # 1 picked in the model
getLocation = Element.GetLocation(element=select_model_elements)
X = Point.X(point=getLocation)
Y = Point.Y(point=getLocation)
list_of_elements = Python(IN[0]=select_model_elements)  # CPython3
# ---------- list_of_elements.python (14 lines) ----------
# Carga las bibliotecas de DesignScript y normas de Python.
import sys
import clr
clr.AddReference('ProtoGeometry')
from Autodesk.DesignScript.Geometry import *

# Las entradas de este nodo se almacenan como lista en las variables IN.
dataEnteringNode = IN

# Incluya el código debajo de esta línea
b_elems= IN[0]

# Asigne la salida a la variable OUT.
OUT = b_elems
# ----------------------------------------
parameters = Element.Parameters(element=list_of_elements)
value = Parameter.Value(parameter=parameters)
code_block = CodeBlock(param=value) { param[23]; }
projectElevation = Level.ProjectElevation(level=code_block)
base_point_of_first_column = Python(IN[0]=X, IN[1]=Y, IN[2]=projectElevation)  # CPython3
# ---------- base_point_of_first_column.python (19 lines) ----------
# Carga las bibliotecas de DesignScript y normas de Python.
import sys
import clr
clr.AddReference('ProtoGeometry')
from Autodesk.DesignScript.Geometry import *

# Las entradas de este nodo se almacenan como lista en las variables IN.
dataEnteringNode = IN


# Las entradas de este nodo se almacenan como lista en las variables IN.
dataEnteringNode = IN
locPx=IN[0]
locPy=IN[1]
locPz=IN[2]


# Asigne la salida a la variable OUT.
OUT = [locPx,locPy,locPz]
# ----------------------------------------
ZAxis = Vector.ZAxis()
separation_of_links_in_columns = CodeBlock(dimShearBar=importCSV, initCols=base_point_of_first_column, direCols=ZAxis) { dimShearBar; initCols; direCols; }
file_path_2 = Filename("Design_Data\RebarMSColumns\DimColsCollec.csv")
boolean_2 = BoolSelector(true)
importCSV_2 = Data.ImportCSV(filePath=file_path_2, transpose=boolean_2)
dimensions_of_columns = CodeBlock(beamDim=importCSV_2) { beamDim; }
file_path_3 = Filename("Design_Data\RebarMSColumns\nColsCollec.csv")
boolean_3 = BoolSelector(true)
importCSV_3 = Data.ImportCSV(filePath=file_path_3, transpose=boolean_3)
distribution_stirrrup_ties = Python(IN[0]=separation_of_links_in_columns.dimShearBar, IN[1]=dimensions_of_columns, IN[2]=importCSV_3)  # CPython3
# ---------- distribution_stirrrup_ties.python (63 lines) ----------
# Carga las bibliotecas de DesignScript y normas de Python.
import sys
import clr
clr.AddReference('ProtoGeometry')
from Autodesk.DesignScript.Geometry import *

# Las entradas de este nodo se almacenan como lista en las variables IN.
dataEnteringNode = IN

dimShear=IN[0]
dimCols=IN[1]
nMultiCols=IN[2]
ncols=nMultiCols[0][0]
# Incluya el código debajo de esta línea
z_global=[]
n1=[]
n2=[]
n3=[]
for j in range(0,ncols):
    iCx=3*ncols
    iHc=2*ncols+j
    id1=(j+1)*5-5
    id2=(j+1)*5-4
    a=dimCols[0][iCx] # horizontal concrete cover
    d1=dimShear[0][id1]
    d2=dimShear[0][id2]
    lenCol=dimCols[0][iHc]
    
    # Lower part of columns
    is1=(j+1)*5-3
    is2=(j+1)*5-2
    sep1=dimShear[0][is1]
    
    n1.append(int((d1-2*a)/sep1)+1)
    ze=a
    z1=[]
    for i in range(0,n1[j]):
        z1.append(ze)
        ze=ze+sep1
    
    # Mid part of column
    sep2=dimShear[0][is2]
    d=lenCol-2*d1
    n2.append(int((d-2*a)/sep2)+1)
    
    for i in range(0,n2[j]):
        z1.append(ze)
        ze=ze+sep2
    
    # Upper part of column
    sep3=sep1
    n3.append(int((d1-2*a)/sep3)+2)
    
    ze=ze-sep2+sep3
    #ze=ze-sep3
    for i in range(0,n3[j]):
        z1.append(ze)
        ze=ze+sep3
    
    z_global.append(z1)
	
# Asigne la salida a la variable OUT.
OUT = z_global
# ----------------------------------------
curve_stirrup_links = Python(IN[0]=separation_of_links_in_columns.dimShearBar, IN[1]=separation_of_links_in_columns.initCols, IN[2]=separation_of_links_in_columns.direCols, IN[3]=dimensions_of_columns, IN[4]=importCSV_3)  # CPython3
# ---------- curve_stirrup_links.python (65 lines) ----------
# Carga las bibliotecas de DesignScript y normas de Python.
import sys
import clr
clr.AddReference('ProtoGeometry')
from Autodesk.DesignScript.Geometry import *

# Las entradas de este nodo se almacenan como lista en las variables IN.
dataEnteringNode = IN

shearCols=IN[0]
initCol=IN[1]
dirCols=IN[2]
dimCols=IN[3]
nMultiCols=IN[4]
ncols=nMultiCols[0][0]

# Incluya el código debajo de esta línea
pol_curv=[]

xbi=initCol[0]
ybi=initCol[1]
zbi=initCol[2]

dxb=0
dyb=0
dzb=1
for i in range(0,ncols):
    ib=i
    ih=ncols+i
    iHc=2*ncols+i
    iCx=3*ncols
    iCy=3*ncols+1
    idsi=(i+1)*5-1
    
    b=dimCols[0][ib]
    h=dimCols[0][ih]
    
    brec=dimCols[0][iCx]
    hrec=dimCols[0][iCy]
    
    
    Hcol=dimCols[0][iHc]
    dvsi=shearCols[0][idsi]
    
    xncornerLink=0.5*b-brec-0.5*dvsi
    yncornerLink=0.5*h-hrec-0.5*dvsi
    
    
    pcb1=Point.ByCoordinates(xbi+xncornerLink,ybi-yncornerLink,zbi+i*Hcol)
    pcb2=Point.ByCoordinates(xbi+xncornerLink,ybi+yncornerLink,zbi+i*Hcol)
    pcb3=Point.ByCoordinates(xbi-xncornerLink,ybi+yncornerLink,zbi+i*Hcol)
    pcb4=Point.ByCoordinates(xbi-xncornerLink,ybi-yncornerLink,zbi+i*Hcol)
    
    curve1=Line.ByStartPointEndPoint(pcb1,pcb2)
    curve2=Line.ByStartPointEndPoint(pcb2,pcb3)
    curve3=Line.ByStartPointEndPoint(pcb3,pcb4)
    curve4=Line.ByStartPointEndPoint(pcb4,pcb1)
    
    curve_link=[curve1,curve2,curve3,curve4]

    pc=PolyCurve.ByJoinedCurves(curve_link)
    pol_curv.append(pc)
 
# Asigne la salida a la variable OUT.
OUT = pol_curv
# ----------------------------------------
all_links_per_column_in_multi = Python(IN[0]=distribution_stirrrup_ties, IN[1]=separation_of_links_in_columns.direCols, IN[2]=curve_stirrup_links)  # "All links per column in Multi-column"; CPython3
# ---------- all_links_per_column_in_multi.python (33 lines) ----------
# Carga las bibliotecas de DesignScript y normas de Python.
import sys
import clr
clr.AddReference('ProtoGeometry')
from Autodesk.DesignScript.Geometry import *

# Las entradas de este nodo se almacenan como lista en las variables IN.
dataEnteringNode = IN

copiesLinksCols=IN[0]
direcCols=IN[1]
listLinks=IN[2]


dbx=0
dby=0
dbz=1

# Incluya el código debajo de esta línea
ncols=len(listLinks)

linksCols=[]
for i in range(0,ncols):
    
    copLink=[]
    nlinks=len(copiesLinksCols[i])
    for j in range(0,nlinks):
        copiedLinked=Geometry.Translate(listLinks[i],copiesLinksCols[i][j]*dbx,copiesLinksCols[i][j]*dby,copiesLinksCols[i][j]*dbz)
        copLink.append(copiedLinked)
    linksCols.append(copLink)
        
# Asigne la salida a la variable OUT.
OUT = linksCols
# ----------------------------------------
explode = Geometry.Explode(geometry=all_links_per_column_in_multi)
rebarStyle = RevitRebarStyle("StirrupTie")
diameter_of_shear_links = Python(IN[0]=importCSV, IN[1]=importCSV_3)  # CPython3
# ---------- diameter_of_shear_links.python (22 lines) ----------
# Carga las bibliotecas de DesignScript y normas de Python.
import sys
import clr
clr.AddReference('ProtoGeometry')
from Autodesk.DesignScript.Geometry import *

# Las entradas de este nodo se almacenan como lista en las variables IN.
dataEnteringNode = IN

shearCols=IN[0]
nMultiCols=IN[1]

StrdiamRebarLink=[]
ncols=nMultiCols[0][0]
for i in range(0,ncols):
    id=(i+1)*5-1
    dlinks=int(shearCols[0][id])
    strconcdiami="H"+str(dlinks)
    StrdiamRebarLink.append(strconcdiami)
    
# Asigne la salida a la variable OUT.
OUT = StrdiamRebarLink
# ----------------------------------------
rebarBarTypefromName = Custom[RebarBarTypefromName](listofrebarbartypes=diameter_of_shear_links)  # package PracticalBIM; Gets the Rebar Bar Types from a List with names
rebarHookType = RevitRebarHookType("Stirrup/Tie - 135 deg.")
rebarHookOrientation = RevitRebarHookOrientation("Left")
all_links = Python(IN[0]=all_links_per_column_in_multi)  # CPython3
# ---------- all_links.python (23 lines) ----------
# Carga las bibliotecas de DesignScript y normas de Python.
import sys
import clr
clr.AddReference('ProtoGeometry')
from Autodesk.DesignScript.Geometry import *

# Las entradas de este nodo se almacenan como lista en las variables IN.
dataEnteringNode = IN

list_curves=IN[0]

nc=len(list_curves)
# Incluya el código debajo de esta línea

list_last_curves=[]
for i in range(0,nc):
	curves=[]
	ne=len(list_curves[i])
	curves.append(list_curves[i][ne-1])
	list_last_curves.append(list_curves[i][ne-1])
# Asigne la salida a la variable OUT.

OUT = list_last_curves
# ----------------------------------------
normal = Curve.Normal(curve=all_links)
fromCurves = StructuralDesign.Rebar.Create.FromCurves(curves=explode, rebarStyle=rebarStyle, rebarBarType=rebarBarTypefromName, startHookType=rebarHookType, endHookType=rebarHookType, startHookOrientation=rebarHookOrientation, endHookOrientation=rebarHookOrientation, hostElement=list_of_elements, vector=normal)
file_path_4 = Filename("Design_Data\RebarMSColumns\DistrBarCols.csv")
boolean_4 = BoolSelector(true)
importCSV_4 = Data.ImportCSV(filePath=file_path_4, transpose=boolean_4)
file_path_5 = Filename("Design_Data\RebarMSColumns\nBarColsCollec.csv")
boolean_5 = BoolSelector(true)
importCSV_5 = Data.ImportCSV(filePath=file_path_5, transpose=boolean_5)
file_path_6 = Filename("Design_Data\RebarMSColumns\ListDiamBarCols.csv")
boolean_6 = BoolSelector(false)
importCSV_6 = Data.ImportCSV(filePath=file_path_6, transpose=boolean_6)
file_path_7 = Filename("Design_Data\RebarMSColumns\IDRebar2CutCols.csv")
boolean_7 = BoolSelector(false)
importCSV_7 = Data.ImportCSV(filePath=file_path_7, transpose=boolean_7)
longitudinal_rebar_axes = Python(IN[0]=importCSV, IN[1]=importCSV_2, IN[2]=base_point_of_first_column, IN[3]=importCSV_4, IN[4]=importCSV_5, IN[5]=importCSV_3, IN[6]=importCSV_6, IN[7]=importCSV_7)  # CPython3
# ---------- longitudinal_rebar_axes.python (96 lines) ----------
# Carga las bibliotecas de DesignScript y normas de Python.
import sys
import clr
clr.AddReference('ProtoGeometry')
from Autodesk.DesignScript.Geometry import *
import math as m

dataEnteringNode = IN

dvsCols=IN[0]
DimCols=IN[1]
originCols=IN[2]
distrRebarCol=IN[3]
NbarsCols=IN[4]
nMultiCols=IN[5]
listDiamCol=IN[6]
rebars2Cut=IN[7]

# Distribution of rebar
axRebar=[]
axRebarBent=[]
ncols=nMultiCols[0][0]
direcColVec1=Vector.ByCoordinates(0,0,1)

xci=originCols[0]
yci=originCols[1]
zci=originCols[2]

direcCix=0
direcBiy=0
direcBiz=1

nbarsCum=0
zloc=zci
for i in range(0,ncols):
    ib=i
    ih=ncols+i
    iHc=2*ncols+i
    iCx=3*ncols
    iCy=3*ncols+1
    
    b=DimCols[0][ib]
    h=DimCols[0][ih]
    Cy=DimCols[0][iCy]
    Cx=DimCols[0][iCx]
    Hc=DimCols[0][iHc]
    
    idv=(i+1)*5-1
    dvCol=dvsCols[0][idv]
    if ncols>1:
        if i<ncols-1:
            dh=DimCols[0][ih]-DimCols[0][ih+1]
            lbari=Hc-dh/2
        else:
            lbari=Hc+dh/2
    else:
        lbari=Hc+dh/2
    i1=i*3
    i2=(i+1)*3-1
    nbarTotcols=NbarsCols[0][i1]+2*NbarsCols[0][i1+1]+2*NbarsCols[0][i2]
    for j  in range(0,nbarTotcols):
        xrebari=distrRebarCol[nbarsCum+j][0]
        yrebari=distrRebarCol[nbarsCum+j][1]
        
        xloc=xci+xrebari
        yloc=yci+yrebari
        if rebars2Cut[0][nbarsCum+j]==0:
            cutLen=0
        else:
            dbj=listDiamCol[0][nbarsCum+j]
            ldbj=dbj*40
            cutLen=Hc*0.5 - ldbj
        p1b=Point.ByCoordinates(xloc,yloc,zloc)
            
        axisRebari=Line.ByStartPointDirectionLength(p1b,direcColVec1,lbari-cutLen)
        axRebar.append(axisRebari)
        if i>0:
            # Re-scaling current rebar coordinates to connect their initial points
            # to the final points of rebars below for continuity in BIM model
            db=DimCols[0][ib-1]-DimCols[0][ib]
            dh=DimCols[0][ih-1]-DimCols[0][ih]
            sfacb=(b+db)/b
            sfach=(h+dh)/h
            xrebariColBelow=xrebari*sfacb
            yrebariColBelow=yrebari*sfach
            xlocbelow=xci+xrebariColBelow
            ylocbelow=yci+yrebariColBelow
            p0b=Point.ByCoordinates(xlocbelow,ylocbelow,zloc-dh/2)
            axisRebarBenti=Line.ByStartPointEndPoint(p0b,p1b)
            axRebarBent.append(axisRebarBenti)
        
    nbarsCum=nbarsCum+nbarTotcols
    zloc=zloc+Hc
    
# Variable OUT.
OUT = [axRebar,axRebarBent]
# ----------------------------------------
list_of_rebar_diameters = Python(IN[0]=importCSV_5, IN[1]=importCSV_3, IN[2]=importCSV_6)  # CPython3
# ---------- list_of_rebar_diameters.python (35 lines) ----------
# Carga las bibliotecas de DesignScript y normas de Python.
import sys
import clr
clr.AddReference('ProtoGeometry')
from Autodesk.DesignScript.Geometry import *

# Las entradas de este nodo se almacenan como lista en las variables IN.
dataEnteringNode = IN

NbarsCols=IN[0]
nMultiCols=IN[1]
diamBar=IN[2]

nbarsCumCols=0
ncols=nMultiCols[0][0]
    
diamRebarCols=[]
StrdiamRebarCols=[]
nbarcollec=[]
for i in range(0,ncols):
    i1=i*3
    i2=(i+1)*3-1
    nbarcol=NbarsCols[0][i1]+2*NbarsCols[0][i1+1]+2*NbarsCols[0][i2]
    
    for j  in range(0,nbarcol):
        drebari=diamBar[0][nbarsCumCols+j]
        
        diamRebarCols.append(drebari)
        strconcdiami="H"+str(drebari)
        StrdiamRebarCols.append(strconcdiami)
        
    nbarsCumCols=nbarsCumCols+nbarcol
    nbarcollec.append(nbarcol)

OUT = [StrdiamRebarCols]
# ----------------------------------------
rebar_diam_list = CodeBlock(rebarDiam=list_of_rebar_diameters) { rebarDiam; }
rebarBarTypefromName_2 = Custom[RebarBarTypefromName](listofrebarbartypes=rebar_diam_list)
rebar = Python(IN[0]=list_of_elements, IN[1]=longitudinal_rebar_axes, IN[2]=importCSV_2, IN[3]=importCSV_5, IN[4]=rebarBarTypefromName_2, IN[5]=importCSV_3)  # CPython3
# ---------- rebar.python (59 lines) ----------
# Carga las bibliotecas de DesignScript y normas de Python.
import sys
import clr
clr.AddReference('ProtoGeometry')
from Autodesk.DesignScript.Geometry import *

import StructuralDesign as strcdes
# Las entradas de este nodo se almacenan como lista en las variables IN.
dataEnteringNode = IN

hostElm=IN[0]
rebarAx=IN[1]
DimCols=IN[2]
nbCols=IN[3]
rebarTypes=IN[4]
nMultiCols=IN[5]

# Initialization of function

ncols=nMultiCols[0][0]
nrebarCumCols=0
nrebarBentCumCols=0
rebarCols=[]
rebarBentCols=[]
for i in range(0,ncols):
    
    ib=i
    ih=ncols+i
    iHc=2*ncols+i
    iCx=3*ncols
    iCy=3*ncols+1
    
    b=DimCols[0][ib]
    h=DimCols[0][ih]
    Cy=DimCols[0][iCy]
    Cx=DimCols[0][iCx]
    Hc=DimCols[0][iHc]
    
    colElm=hostElm
    
    i1=i*3
    i2=(i+1)*3-1
    nrebarscol=nbCols[0][i1]+2*nbCols[0][i1+1]+2*nbCols[0][i2]
    rebarcol=[]
    rebarBentcol=[]
    for j in range(0,nrebarscol):
        rebari=strcdes.Rebar.Create.FreeFormRebar(rebarTypes[0][nrebarCumCols+j],colElm,[[rebarAx[0][nrebarCumCols+j]]])
        rebarcol.append(rebari)
        if i>0:
            rebarBenti=strcdes.Rebar.Create.FreeFormRebar(rebarTypes[0][nrebarCumCols+j],colElm,[[rebarAx[1][nrebarBentCumCols+j]]])
            rebarBentcol.append(rebarBenti)
        
    rebarCols.append(rebarcol)
    nrebarCumCols=nrebarCumCols+nrebarscol
    if i>0:
        rebarBentCols.append(rebarBentcol)
        nrebarBentCumCols=nrebarBentCumCols+nrebarscol
    
OUT = [rebarCols,rebarBentCols]
# ----------------------------------------
file_path_8 = Filename("Design_Data\RebarMSColumns\DiamBarColsCollec.csv")
boolean_8 = BoolSelector(true)
importCSV_8 = Data.ImportCSV(filePath=file_path_8, transpose=boolean_8)
geometry = Element.Geometry(element=list_of_elements)
Z = Vector.Z(vector=ZAxis)
faces = Element.Faces()  # unwired: element
createByCurveAndShapeCode = StructuralDesign.Rebar.PathReinforcement.PathReinforcement.CreateByCurveAndShapeCode()  # unwired: hostElement, curvesPath
