# Dynamo graph PadFootingsRebar.dyn (Dynamo 2.19.3.6394)
# packages: PracticalBIM 2020.0.43

select_model_elements = DSModelElementsSelection()  # 1 picked in the model
geometry = Element.Geometry(element=select_model_elements)
explode = Geometry.Explode(geometry=geometry)
normalAtParameter = Surface.NormalAtParameter(surface=explode)
Z = Vector.Z(vector=normalAtParameter)
perimeterCurves = Surface.PerimeterCurves(surface=explode)
direction = Line.Direction(line=perimeterCurves)
dimensions_of_footing_per_axis = Python(IN[0]=Z, IN[1]=direction)  # CPython3
# ---------- dimensions_of_footing_per_axis.python (26 lines) ----------
# Carga las bibliotecas de DesignScript y normas de Python.
import sys
import clr
clr.AddReference('ProtoGeometry')
from Autodesk.DesignScript.Geometry import *

# Las entradas de este nodo se almacenan como lista en las variables IN.
dataEnteringNode = IN
zComp=IN[0]
dirPerLines=IN[1]

# Incluya el código debajo de esta línea

for i in range(0,6):
    if abs(zComp[0][i])==1:
        for j in range(0,4):
            xl=dirPerLines[0][i][j].X
            yl=dirPerLines[0][i][j].Y
            
            if xl == 0:
                ly = abs(yl)
            elif yl == 0:
                lx = abs(xl)

# Asigne la salida a la variable OUT.
OUT = [[lx,ly]]
# ----------------------------------------
getLocation = Element.GetLocation(element=select_model_elements)
X = Point.X(point=getLocation)
Y = Point.Y(point=getLocation)
Z_2 = Point.Z(point=getLocation)
point_location_of_pad_footing = Python(IN[0]=X, IN[1]=Y, IN[2]=Z_2)  # CPython3
# ---------- point_location_of_pad_footing.python (20 lines) ----------
# Carga las bibliotecas de DesignScript y normas de Python.
import sys
import clr
clr.AddReference('ProtoGeometry')
from Autodesk.DesignScript.Geometry import *

# Las entradas de este nodo se almacenan como lista en las variables IN.
dataEnteringNode = IN

# Incluya el código debajo de esta línea

# Asigne la salida a la variable OUT.
dataEnteringNode = IN

locPointsx=IN[0]
locPointsy=IN[1]
locPointsz=IN[2]

# Asigne la salida a la variable OUT.
OUT = [locPointsx,locPointsy,locPointsz]
# ----------------------------------------
file_path = Filename("Design_Data\PadFootings\TendbSec.csv")
boolean = BoolSelector(true)
importCSV = Data.ImportCSV(filePath=file_path, transpose=boolean)
file_path_2 = Filename("Design_Data\PadFootings\dimPadFootCollec.csv")
boolean_2 = BoolSelector(true)
importCSV_2 = Data.ImportCSV(filePath=file_path_2, transpose=boolean_2)
file_path_3 = Filename("Design_Data\PadFootings\DistrBarPadFootLe.csv")
boolean_3 = BoolSelector(true)
importCSV_3 = Data.ImportCSV(filePath=file_path_3, transpose=boolean_3)
file_path_4 = Filename("Design_Data\PileCaps\DistrBarPileCapBe.csv")
boolean_4 = BoolSelector(true)
importCSV_4 = Data.ImportCSV(filePath=file_path_4, transpose=boolean_4)
file_path_5 = Filename("Design_Data\PadFootings\nBarPadFootCollec.csv")
boolean_5 = BoolSelector(true)
importCSV_5 = Data.ImportCSV(filePath=file_path_5, transpose=boolean_5)
file_path_6 = Filename("Design_Data\PadFootings\DiamListBe.csv")
boolean_6 = BoolSelector(true)
importCSV_6 = Data.ImportCSV(filePath=file_path_6, transpose=boolean_6)
file_path_7 = Filename("Design_Data\PadFootings\DiamListLe.csv")
boolean_7 = BoolSelector(true)
importCSV_7 = Data.ImportCSV(filePath=file_path_7, transpose=boolean_7)
longitudinal_rebar_axes = Python(IN[0]=dimensions_of_footing_per_axis, IN[1]=point_location_of_pad_footing, IN[2]=importCSV, IN[3]=importCSV_2, IN[4]=importCSV_3, IN[5]=importCSV_4, IN[6]=importCSV_5, IN[7]=importCSV_6, IN[8]=importCSV_7)  # CPython3
# ---------- longitudinal_rebar_axes.python (125 lines) ----------
# Carga las bibliotecas de DesignScript y normas de Python.
import sys
import clr
clr.AddReference('ProtoGeometry')
from Autodesk.DesignScript.Geometry import *
import math as m

import StructuralDesign as strcdes
# Las entradas de este nodo se almacenan como lista en las variables IN.
dataEnteringNode = IN

dimCapsXY=IN[0]
originCaps=IN[1]
dbTenCaps=IN[2]
dimCaps=IN[3]
distrCapLe=IN[4]
distrCapBe=IN[5]
nbarsCaps=IN[6]
diamListBe=IN[7]
diamListLe=IN[8]

# Distribution of rebar - Left section

anchorLenBentBars=[]
axRebarLe=[]
axRebarBe=[]

nCaps=len(dbTenCaps)
nbarsCumLe=0
nbarsCumBe=0
led = 0
for i in range(0,nCaps):
    
    xbi=originCaps[0]
    ybi=originCaps[1]
    zbi=originCaps[2]
    
    Lei=dimCaps[i][0]
    Bei=dimCaps[i][1]
    h=dimCaps[i][2]
    Cc=dimCaps[i][3]
    
    dLe = dbTenCaps[i][0]
    dBe = dbTenCaps[i][1]
    # Le section
    if abs(Lei - dimCapsXY[i][0]) < 0.1: # Le is along x
                               # rebars, then, must be extruded in the y direction
        led = 1
    elif abs(Lei - dimCapsXY[i][1]) < 0.1: # Le is along y
                               # rebars, then, must be extruded in the x direction
        led = 2
    
    nbartLe=nbarsCaps[i][0]
    nbartBe=nbarsCaps[i][1]
    for j  in range(0,nbartLe):
        xrebari=distrCapLe[nbarsCumLe+j][0]
        yrebari=distrCapLe[nbarsCumLe+j][1]
        
        lbariL=Bei - 2*Cc
        if led == 1:
            xc = 1
            yc = 0
            dirVecRebar = Vector.ByCoordinates(0,1,0)
        elif led == 2:
            xc = 0
            yc = 1
            dirVecRebar = Vector.ByCoordinates(1,0,0)
            
        xloc = xbi + xrebari*xc - (0.5 * Bei - Cc)*yc
        yloc = ybi + xrebari*yc - (0.5 * Bei - Cc)*xc
        zloc = zbi - 0.5*h + yrebari
        
        p0b=Point.ByCoordinates(xloc,yloc,zloc + 12* dLe)
        p1b=Point.ByCoordinates(xloc,yloc,zloc)
        p2b=Point.ByCoordinates(xloc + yc * lbariL, yloc + xc * lbariL,zloc)
        p3b=Point.ByCoordinates(xloc + yc * lbariL, yloc + xc * lbariL,zloc + 12* dLe)
        
        axisRebari0=Line.ByStartPointEndPoint(p0b,p1b)
        axisRebari=Line.ByStartPointEndPoint(p1b,p2b)
        axisRebari2=Line.ByStartPointEndPoint(p2b,p3b)
        
        axisRebar=[axisRebari0,axisRebari,axisRebari2]
        
        #axisRebari=Line.ByStartPointDirectionLength(p1b,dirVecRebar,lbariL)
        axRebarLe.append(axisRebar)
    
    # Be section
    for j  in range(0,nbartBe):
        xrebari=distrCapBe[nbarsCumBe+j][0]
        yrebari=distrCapBe[nbarsCumBe+j][1]
        lbariL=Lei - 2*Cc
        
        if led == 1:
            xc = 0
            yc = 1
            dirVecRebar = Vector.ByCoordinates(1,0,0)
        elif led == 2:
            xc = 1
            yc = 0
            dirVecRebar = Vector.ByCoordinates(0,1,0)
            
        
        xloc = xbi + xrebari*xc - (0.5 * Lei - Cc)*yc
        yloc = ybi + xrebari*yc - (0.5 * Lei - Cc)*xc
        zloc = zbi -0.5*h + yrebari
        
        
        p0b=Point.ByCoordinates(xloc,yloc,zloc + 12* dBe)
        p1b=Point.ByCoordinates(xloc,yloc,zloc)
        p2b=Point.ByCoordinates(xloc + yc * lbariL, yloc + xc * lbariL,zloc)
        p3b=Point.ByCoordinates(xloc + yc * lbariL, yloc + xc * lbariL,zloc + 12* dBe)
        
        axisRebari0=Line.ByStartPointEndPoint(p0b,p1b)
        axisRebari=Line.ByStartPointEndPoint(p1b,p2b)
        axisRebari2=Line.ByStartPointEndPoint(p2b,p3b)
        #axisRebari=Line.ByStartPointDirectionLength(p1b,dirVecRebar,lbariL)
        
        axisRebar = [axisRebari0,axisRebari,axisRebari2]
        axRebarBe.append(axisRebar)
        
    nbarsCumLe=nbarsCumLe+nbartLe
    nbarsCumBe=nbarsCumBe+nbartBe
    
# Asigne la salida a la variable OUT.
OUT = [axRebarLe,axRebarBe]
# ----------------------------------------
list_of_rebar_diameters = Python(IN[0]=importCSV_5, IN[1]=importCSV_6, IN[2]=importCSV_7)  # CPython3
# ---------- list_of_rebar_diameters.python (44 lines) ----------
# Carga las bibliotecas de DesignScript y normas de Python.
import sys
import clr
clr.AddReference('ProtoGeometry')
from Autodesk.DesignScript.Geometry import *

# Las entradas de este nodo se almacenan como lista en las variables IN.
dataEnteringNode = IN
NbarsTen=IN[0]
diamBarTenBe=IN[1]
diamBarTenLe=IN[2]

ncaps=len(NbarsTen)
diamRebarTenLe=[]
StrdiamRebarTenLe=[]

diamRebarTenBe=[]
StrdiamRebarTenBe=[]

nbarsCumTenLe=0
nbarsCumTenBe=0
for i in range(0,ncaps):
    # Le section
    nbartLe=int(NbarsTen[i][0]+NbarsTen[i][1])
    
    for j in range(0,nbartLe):
        drebari=diamBarTenLe[nbarsCumTenLe+j][0]
        diamRebarTenLe.append(drebari)
        strconcdiami="H"+str(drebari)
        StrdiamRebarTenLe.append(strconcdiami)
        
    # Be section
    nbartBe=int(NbarsTen[i][2]+NbarsTen[i][3])
    for j  in range(0,nbartBe):
        drebari=diamBarTenBe[nbarsCumTenBe+j][0]
        diamRebarTenBe.append(drebari)
        strconcdiami="H"+str(drebari)
        StrdiamRebarTenBe.append(strconcdiami)
        
    nbarsCumTenLe=nbarsCumTenLe+nbartLe
    nbarsCumTenBe=nbarsCumTenBe+nbartBe
    
    
OUT = [StrdiamRebarTenLe,StrdiamRebarTenBe]
# ----------------------------------------
rebar_list_left = CodeBlock(rebarDiam=list_of_rebar_diameters) { rebarDiam[0]; rebarDiam[1]; }
rebarBarTypefromName = Custom[RebarBarTypefromName](listofrebarbartypes=rebar_list_left.out0)  # package PracticalBIM; Gets the Rebar Bar Types from a List with names
rebarBarTypefromName_2 = Custom[RebarBarTypefromName](listofrebarbartypes=rebar_list_left.out1)
rebar = Python(IN[0]=select_model_elements, IN[1]=longitudinal_rebar_axes, IN[2]=importCSV_2, IN[3]=importCSV_5, IN[4]=rebarBarTypefromName, IN[5]=rebarBarTypefromName_2)  # CPython3
# ---------- rebar.python (59 lines) ----------
# Carga las bibliotecas de DesignScript y normas de Python.
import sys
import clr
clr.AddReference('ProtoGeometry')
from Autodesk.DesignScript.Geometry import *

import StructuralDesign as strcdes
# Las entradas de este nodo se almacenan como lista en las variables IN.
dataEnteringNode = IN

hostElm=IN[0]
rebarAx=IN[1]
dimCaps=IN[2]
nbarsCaps=IN[3]
rebarTypesLe=IN[4]
rebarTypesBe=IN[5]

# Initialization of function
rebarAxLe=rebarAx[0]
rebarAxBe=rebarAx[1]
nrebarCumLe=0
nrebarCumBe=0

rebarLe=[]
rebarBe=[]
nrebarRCumLenDif0=0
for i in range(0,1):
    
    capElm=hostElm
    # Le section
    nrebarsCapLe=nbarsCaps[i][0]
    rebarCapLe=[]
    jj=0
    for j in range(0,nrebarsCapLe):
        rebari=strcdes.Rebar.Create.FreeFormRebar(rebarTypesLe[nrebarCumLe+j],capElm,[[rebarAxLe[nrebarCumLe+j][0],rebarAxLe[nrebarCumLe+j][1],rebarAxLe[nrebarCumLe+j][2]]])
        
        #rebari=strcdes.Rebar.Create.FromCurves([rebarAxLe[nrebarCumLe+j][0],rebarAxLe[nrebarCumLe+j][1],rebarAxLe[nrebarCumLe+j][2]],"Standard",rebarTypesLe[nrebarCumLe+j],"Standard - 90 deg.","Standard - 90 deg.","Left","Right",capElm,vecNormalRebarLe)
        
        rebarCapLe.append(rebari)
        
    rebarLe.append(rebarCapLe)
    nrebarCumLe=nrebarCumLe+nrebarsCapLe
    
    # Be section
    
    nrebarsCapBe=nbarsCaps[i][1]
    rebarCapBe=[]
    for j in range(0,nrebarsCapBe):
        rebari=strcdes.Rebar.Create.FreeFormRebar(rebarTypesBe[nrebarCumBe+j],capElm,[[rebarAxBe[nrebarCumBe+j][0],rebarAxBe[nrebarCumBe+j][1],rebarAxBe[nrebarCumBe+j][2]]])
        
        #rebari=strcdes.Rebar.Create.FromCurves([rebarAxBe[nrebarCumBe+j][0],rebarAxBe[nrebarCumBe+j][1],rebarAxBe[nrebarCumBe+j][2]],"Standard",rebarTypesBe[nrebarCumBe+j],"Standard - 90 deg.","Standard - 90 deg.","Left","Right",capElm,vecNormalRebarBe)
        
        rebarCapBe.append(rebari)
    
    rebarBe.append(rebarCapBe)
    nrebarCumBe=nrebarCumBe+nrebarsCapBe
    
# Asigne la salida a la variable OUT.
OUT = [rebarLe,rebarBe,rebarAxBe]
# ----------------------------------------
